% Simulink data dictionary ClimaManModMgr.sldd

CCMLifeCycleModeGroup = enum(HeaderFile="Rte_Type.h", DefaultValue="StartUp", StorageType="uint8")
  StartUp = 1
  Normal = 0

ClimaCfgForCarTyp1 = enum(HeaderFile="Rte_Type.h", DefaultValue="CarTyp0", StorageType="uint8", AddClassNameToEnumNames=true)
  CarTyp0 = 0
  CarTyp1 = 1
  CarTyp2 = 2

ClimaCfgForHeatrTyp1 = enum(HeaderFile="Rte_Type.h", DefaultValue="NoHeatr", StorageType="uint8", AddClassNameToEnumNames=true)
  NoHeatr = 1
  FuHeatr = 2
  HvHeatr = 3
  PrkgHeatrElec = 4
  Hv12V = 128

MaxGear = enum(HeaderFile="Rte_Type.h", DefaultValue="Max4Gear", StorageType="uint8", AddClassNameToEnumNames=true)
  Max4Gear = 0
  Max5Gear = 1
  Max6Gear = 2
  Max7Gear = 3
  Max8Gear = 4
  Max9Gear = 5

ClimaCfgForNrOfFanLvlSetg1 = enum(HeaderFile="Rte_Type.h", DefaultValue="NrOfFanLvlSetg1", StorageType="uint8", AddClassNameToEnumNames=true)
  NrOfFanLvlSetg1 = 0
  NrOfFanLvlSetg2 = 1
  NrOfFanLvlSetg3 = 2
  NrOfFanLvlSetg4 = 3

ClimaCfgForNrOfTSetg1 = enum(HeaderFile="Rte_Type.h", DefaultValue="NrOfTSetg1", StorageType="uint8", AddClassNameToEnumNames=true)
  NrOfTSetg1 = 0
  NrOfTSetg2 = 1
  NrOfTSetg3 = 2
  NrOfTSetg4 = 3

ClimaStStrtUp = enum(HeaderFile="Rte_Type.h", DefaultValue="Comfort", StorageType="uint8", AddClassNameToEnumNames=true)
  Comfort = 0
  Cooldown = 1
  Heatup = 2

HmiCmptmtAirDistbnFrnt = enum(HeaderFile="Rte_Type.h", DefaultValue="Flr", StorageType="uint8", AddClassNameToEnumNames=true)
  Flr = 0
  Vent = 1
  Defrst = 2
  FlrDefrst = 3
  FlrVent = 4
  VentDefrst = 5
  FlrVentDefrst = 6
  Aut = 7

PreClngSts = enum(HeaderFile="Rte_Type.h", DefaultValue="Off", StorageType="uint8", AddClassNameToEnumNames=true)
  Off = 0
  UniqueActv = 1
  WithPreCdngActv = 2

PrkgClimaActv = enum(HeaderFile="Rte_Type.h", DefaultValue="Off", StorageType="uint8", AddClassNameToEnumNames=true)
  Off = 0
  PreCdngActv = 1
  PostCdngActv = 2
  BlwAftRunActv = 3

ClimaCfgForActrModVrnt1 = enum(HeaderFile="Rte_Type.h", DefaultValue="FlapInd", StorageType="uint8", AddClassNameToEnumNames=true)
  FlapInd = 0
  VentFlrCmn = 1
  FlrVentCmn = 2
  FlrVentDefrCmn = 3

ClimaCfgForActrModVrnt2 = enum(HeaderFile="Rte_Type.h", DefaultValue="FlapInd", StorageType="uint8", AddClassNameToEnumNames=true)
  FlapInd = 0
  VentFlrCmn = 1
  FlrVentCmn = 2
  FlrVentDefrCmn = 3
  VentFlrCmnAdjmt = 4
  FlrVentCmnAdjmt = 5
  WithoutFlap = 6

HvacFanLvlFb = enum(HeaderFile="Rte_Type.h", DefaultValue="Off", StorageType="uint8", AddClassNameToEnumNames=true)
  Off = 0
  Min = 1
  Lvl1 = 2
  Lvl2 = 3
  Lvl3 = 4
  Lvl4 = 5
  Lvl5 = 6
  Lvl6 = 7
  Lvl7 = 8
  Max = 9

ActrPosnMax = Simulink.Parameter(100, StorageClass="Define", DataType="Perc30")  % Max request for actuator position
ActrPosnMin = Simulink.Parameter(0, StorageClass="Define", DataType="Perc30")  % Min request for actuator position
ActvnTiMinForClimaCtrlForRateLimOfHeatgT = AUTOSAR4.Parameter(2, DoubleProperty=0, Int32Property=int32(0), LogicalProperty=false, OnOffStringProperty="off", ColorStringProperty="red", StorageClass="CalData", MemorySection="CCM_CAL", DataType="VCCTi33", Min=0, Max=10, Unit="Sec")  % Min activation time of ClimaCtrl before rate limit of hex temp for airflow limit. [s]
AdjFacForAirFlowForHiForFanSetLvlAutForRowFirst = AUTOSAR4.Parameter([0.8 0.9 1 1.1 1.2], DoubleProperty=0, Int32Property=int32(0), LogicalProperty=false, OnOffStringProperty="off", ColorStringProperty="red", StorageClass="CalData", MemorySection="CCM_CAL", DataType="VCCFac30", Min=0, Max=1.99, Unit="NoUnit")  % Adjustment factor for airflow for first row during Hi.
AdjFacForAirFlowForHiForFanSetLvlAutForRowSec = AUTOSAR4.Parameter([0.8 0.9 1 1.1 1.2], DoubleProperty=0, Int32Property=int32(0), LogicalProperty=false, OnOffStringProperty="off", ColorStringProperty="red", StorageClass="CalData", MemorySection="CCM_CAL", DataType="VCCFac30", Min=0, Max=1.99, Unit="NoUnit")  % Adjustment factor for airflow for sec row during Hi.
AdjLoForFanSetLvlAutForRowFirst = AUTOSAR4.Parameter([0.8 0.9 1 1.1 1.2], DoubleProperty=0, Int32Property=int32(0), LogicalProperty=false, OnOffStringProperty="off", ColorStringProperty="red", StorageClass="CalData", MemorySection="CCM_CAL", DataType="VCCFac30", Min=0, Max=1.99, Unit="NoUnit")  % Adjustment factor for first row during Lo.
AdjLoForFanSetLvlAutForRowSec = AUTOSAR4.Parameter([0.8 0.9 1 1.1 1.2], DoubleProperty=0, Int32Property=int32(0), LogicalProperty=false, OnOffStringProperty="off", ColorStringProperty="red", StorageClass="CalData", MemorySection="CCM_CAL", DataType="VCCFac30", Min=0, Max=1.99, Unit="NoUnit")  % Adjustment factor for second row during Lo.
AirFlow30 = Simulink.NumericType(DataTypeMode="Fixed-point: slope and bias scaling", SignednessBool=true, WordLength=16, FixedExponent=-5, HeaderFile="Rte_Type.h")
AirFlowDurgBlwAftRun = AUTOSAR4.Parameter(180, DoubleProperty=0, Int32Property=int32(0), LogicalProperty=false, OnOffStringProperty="off", ColorStringProperty="red", StorageClass="CalData", MemorySection="CCM_CAL", DataType="AirFlow30", Min=0, Max=700, Unit="KgPerHour")  % Total airflow during blower after running. [Kg/h]
AirFlowDurgDefrstMax = AUTOSAR4.Parameter([150 170 200 230 250], DoubleProperty=0, Int32Property=int32(0), LogicalProperty=false, OnOffStringProperty="off", ColorStringProperty="red", StorageClass="CalData", MemorySection="CCM_CAL", DataType="AirFlow30", Min=0, Max=750, Unit="KgPerHour")  % Total airflow during max defroster for first seat row.
AirFlowForDefrstDurgPreClng = AUTOSAR4.Parameter(0, DoubleProperty=0, Int32Property=int32(0), LogicalProperty=false, OnOffStringProperty="off", ColorStringProperty="red", StorageClass="CalData", MemorySection="CCM_CAL", DataType="AirFlow30", Min=0, Max=300, Unit="KgPerHour")  % Defroster airflow during precleaning. [Kg/h]
AirFlowMin = Simulink.Parameter(0, StorageClass="Define", DataType="AirFlow30")
AirFlowPartDurgHmiManForRowFirst = AUTOSAR4.Parameter([0.3 0.35 0.4 0.5 0.6 0.7 0.8 0.9 1], DoubleProperty=0, Int32Property=int32(0), LogicalProperty=false, OnOffStringProperty="off", ColorStringProperty="red", StorageClass="CalData", MemorySection="CCM_CAL", DataType="VCCFac30", Min=0, Max=1.99, Unit="NoUnit")  % Airflow part of max estimated airflow during HMI manual fan setting 1-9. [-]
AirFlowPartDurgHmiManForRowFirst1 = AUTOSAR4.Parameter([0.3 0.35 0.4 0.5 0.6 0.7 0.8 0.9 1], DoubleProperty=0, Int32Property=int32(0), LogicalProperty=false, OnOffStringProperty="off", ColorStringProperty="red", StorageClass="CalData", MemorySection="CCM_CAL", DataType="VCCFac30", Min=0, Max=1.99, Unit="NoUnit")  % Airflow part of max estimated airflow during HMI manual fan setting 1-9. [-]
AirFlowPartDurgHmiManForRowSec = AUTOSAR4.Parameter([0.3 0.35 0.4 0.5 0.6 0.7 0.8 0.9 1], DoubleProperty=0, Int32Property=int32(0), LogicalProperty=false, OnOffStringProperty="off", ColorStringProperty="red", StorageClass="CalData", MemorySection="CCM_CAL", DataType="VCCFac30", Min=0, Max=1.99, Unit="NoUnit")  % Airflow part of max estimated airflow during HMI manual fan setting 1-9. [-]
AirFlowScaDurgDefrst = AUTOSAR4.Parameter([1.4 1.3 1.2 1.1 1 1 1], DoubleProperty=0, Int32Property=int32(0), LogicalProperty=false, OnOffStringProperty="off", ColorStringProperty="red", StorageClass="CalData", MemorySection="CCM_CAL", DataType="VCCFac32", Min=0, Max=4, Unit="NoUnit")  % Airflow scale factor when manual Defrost is selected. [-]
AirFlowScaDurgFlr = AUTOSAR4.Parameter([1 1 1 0.8 0.7 0.6 0.5], DoubleProperty=0, Int32Property=int32(0), LogicalProperty=false, OnOffStringProperty="off", ColorStringProperty="red", StorageClass="CalData", MemorySection="CCM_CAL", DataType="VCCFac32", Min=0, Max=4, Unit="NoUnit")  % Airflow scale factor when manual Floor is selected. [-]
AirFlowScaDurgFlrDefrst = AUTOSAR4.Parameter([1 1 1 0.9 0.8 0.7 0.6], DoubleProperty=0, Int32Property=int32(0), LogicalProperty=false, OnOffStringProperty="off", ColorStringProperty="red", StorageClass="CalData", MemorySection="CCM_CAL", DataType="VCCFac32", Min=0, Max=4, Unit="NoUnit")  % Airflow scale factor when manual Floor-Defrost is selected. [-]
AirFlowScaDurgVent = AUTOSAR4.Parameter([1.4 1.3 1.2 1.1 1 1 1], DoubleProperty=0, Int32Property=int32(0), LogicalProperty=false, OnOffStringProperty="off", ColorStringProperty="red", StorageClass="CalData", MemorySection="CCM_CAL", DataType="VCCFac32", Min=0, Max=4, Unit="NoUnit")  % Airflow scale factor when manual Vent is selected. [-]
AirFlowScaDurgVentDefrst = AUTOSAR4.Parameter([1.4 1.3 1.2 1.1 1 1 1], DoubleProperty=0, Int32Property=int32(0), LogicalProperty=false, OnOffStringProperty="off", ColorStringProperty="red", StorageClass="CalData", MemorySection="CCM_CAL", DataType="VCCFac32", Min=0, Max=4, Unit="NoUnit")  % Airflow scale factor when manual Vent-Defrost is selected. [-]
AirFlowScaDurgVentFlr = AUTOSAR4.Parameter([0.6 0.7 0.8 0.9 1 1.1 1.2], DoubleProperty=0, Int32Property=int32(0), LogicalProperty=false, OnOffStringProperty="off", ColorStringProperty="red", StorageClass="CalData", MemorySection="CCM_CAL", DataType="VCCFac32", Min=0, Max=4, Unit="NoUnit")  % Airflow scale factor when manual Vent-Floor is selected. [-]
AirFlowScaDurgVentFlrDefrst = AUTOSAR4.Parameter([1.4 1.3 1.2 1.1 1 1 1], DoubleProperty=0, Int32Property=int32(0), LogicalProperty=false, OnOffStringProperty="off", ColorStringProperty="red", StorageClass="CalData", MemorySection="CCM_CAL", DataType="VCCFac32", Min=0, Max=4, Unit="NoUnit")  % Airflow scale factor when manual Vent-Floor-Defrost is selected. [-]
AirFlowTotDurgCnvincModActvForRowFirst = AUTOSAR4.Parameter([70 90 110 130 150 185], DoubleProperty=0, Int32Property=int32(0), LogicalProperty=false, OnOffStringProperty="off", ColorStringProperty="red", StorageClass="CalData", MemorySection="CCM_CAL", DataType="AirFlow30", Min=0, Max=700, Unit="KgPerHour")  % Airflow during convenience mode for auto fan level 1-5 and max. [kg/h]
AirFlowTotDurgCnvincModActvForRowSec = AUTOSAR4.Parameter([40 50 60 70 80], DoubleProperty=0, Int32Property=int32(0), LogicalProperty=false, OnOffStringProperty="off", ColorStringProperty="red", StorageClass="CalData", MemorySection="CCM_CAL", DataType="AirFlow30", Min=0, Max=700, Unit="KgPerHour")  % Airflow during convenience mode for auto fan level 1-5. [kg/h]
AirFlowTotDurgPreClngUnique = AUTOSAR4.Parameter(300, DoubleProperty=0, Int32Property=int32(0), LogicalProperty=false, OnOffStringProperty="off", ColorStringProperty="red", StorageClass="CalData", MemorySection="CCM_CAL", DataType="AirFlow30", Min=0, Max=700, Unit="KgPerHour")  % Total airflow during unique precleaning. [Kg/h]
AirFlowTotDurgPreClngWithPreCdng = AUTOSAR4.Parameter(140, DoubleProperty=0, Int32Property=int32(0), LogicalProperty=false, OnOffStringProperty="off", ColorStringProperty="red", StorageClass="CalData", MemorySection="CCM_CAL", DataType="AirFlow30", Min=0, Max=700, Unit="KgPerHour")  % Minimum total airflow during combined precleaning with preconditioning. [Kg/h]
AirFlowTotMaxDurgCnvincModActvForRowFirstForFanLvlMan = AUTOSAR4.Parameter(185, DoubleProperty=0, Int32Property=int32(0), LogicalProperty=false, OnOffStringProperty="off", ColorStringProperty="red", StorageClass="CalData", MemorySection="CCM_CAL", DataType="AirFlow30", Min=0, Max=700, Unit="KgPerHour")  % Maximum airflow during convenience mode for manual fan. [kg/h]
AirTFromHeatgDecRateMaxDurgCmftOrCoolDwn = AUTOSAR4.Parameter(-0.5, DoubleProperty=0, Int32Property=int32(0), LogicalProperty=false, OnOffStringProperty="off", ColorStringProperty="red", StorageClass="CalData", MemorySection="CCM_CAL", DataType="VCCT30", Min=-50, Max=0, Unit="DegCgrd")  % Maximum decrease rate for hex temp during comfort or cool-down. [DegC/s]
AirTFromHeatgDecRateMaxDurgHeatUp = AUTOSAR4.Parameter(-0.05, DoubleProperty=0, Int32Property=int32(0), LogicalProperty=false, OnOffStringProperty="off", ColorStringProperty="red", StorageClass="CalData", MemorySection="CCM_CAL", DataType="VCCT30", Min=-50, Max=0, Unit="DegCgrd")  % Maximum decrease rate for hex temp during heat-up. [DegC/s]
AirTFromHeatgDecRateMaxFastForLrgDif = AUTOSAR4.Parameter(-3, DoubleProperty=0, Int32Property=int32(0), LogicalProperty=false, OnOffStringProperty="off", ColorStringProperty="red", StorageClass="CalData", MemorySection="CCM_CAL", DataType="VCCT30", Min=-50, Max=0, Unit="DegCgrd")  % Maximum decrease rate for hex temp for large differences in heat exchanger temperature. [DegC/s]
AirTFromHeatgDifForChgRateFast = AUTOSAR4.Parameter(10, DoubleProperty=0, Int32Property=int32(0), LogicalProperty=false, OnOffStringProperty="off", ColorStringProperty="red", StorageClass="CalData", MemorySection="CCM_CAL", DataType="VCCT30", Min=0, Max=80, Unit="DegCgrd")  % Difference in heat exchanger temperature to activate faster change rate for limited heat exchanger temperature. [DegC]
AirTFromHeatgDifForChgRateFastHys = AUTOSAR4.Parameter(5, DoubleProperty=0, Int32Property=int32(0), LogicalProperty=false, OnOffStringProperty="off", ColorStringProperty="red", StorageClass="CalData", MemorySection="CCM_CAL", DataType="VCCT30", Min=0, Max=80, Unit="DegCgrd")  % Hysteresis for difference in heat exchanger temperature to activate faster change rate for limited heat exchanger temperature. [DegC]
AmntOfSeat = Simulink.Parameter(7, StorageClass="Define", DataType="uint8")  % Number of seats in the car
AutCtrldFlowReqForRowFirstLeAtFlrForStorg = AUTOSAR4.Signal(DoubleProperty=0, Int32Property=int32(0), LogicalProperty=false, OnOffStringProperty="off", ColorStringProperty="red", StorageClass="GlobalDisp", IsReusable=false, DataType="AirFlow30", Min=0, Max=1000, Unit="KgPerHour", InitialValue="0")  % -
AxisActrTAirMFlowReqMaxDriveForManMod = AUTOSAR4.Parameter([0 30 50 70 100], DoubleProperty=0, Int32Property=int32(0), LogicalProperty=false, OnOffStringProperty="off", ColorStringProperty="red", StorageClass="CalData", MemorySection="CCM_CAL", DataType="Perc30", Min=0, Max=100, Unit="Perc")  % Max airflow in hvac for driver for actr temperature position for input ClimaManModMgr.
AxisAmbTForCmftTotFlowLimDurgHeatAvlLo = AUTOSAR4.Parameter([-30 -20 -10 0 10], DoubleProperty=0, Int32Property=int32(0), LogicalProperty=false, OnOffStringProperty="off", ColorStringProperty="red", StorageClass="CalData", MemorySection="CCM_CAL", DataType="VCCT30", Min=-40, Max=50, Unit="DegCgrd")  % Input axis for amb temp for total airflow limit at low hex temp.
AxisAmbTForManDistbn = AUTOSAR4.Parameter([-30 -20 -10 0 5 10 15 20 30 40], DoubleProperty=0, Int32Property=int32(0), LogicalProperty=false, OnOffStringProperty="off", ColorStringProperty="red", StorageClass="CalData", MemorySection="CCM_CAL", DataType="VCCT30", Min=-40, Max=50, Unit="DegCgrd")  % Input axis for amb temp for manual modes airflow parts.
AxisAmbTForPosnReqForActrModForForClimaCtrlMan = AUTOSAR4.Parameter([-10 0 5 10 20 40], DoubleProperty=0, Int32Property=int32(0), LogicalProperty=false, OnOffStringProperty="off", ColorStringProperty="red", StorageClass="CalData", MemorySection="CCM_CAL", DataType="VCCT30", Min=-40, Max=50, Unit="DegCgrd")  % Ambient temp axis for mode distribution in MCC. [Deg C]
AxisFanSetLvlForAirFlowPartDurgHmiManForRowFirst = AUTOSAR4.Parameter([1 2 3 4 5 6 7 8 9], DoubleProperty=0, Int32Property=int32(0), LogicalProperty=false, OnOffStringProperty="off", ColorStringProperty="red", StorageClass="CalData", MemorySection="CCM_CAL", DataType="VCCUInt8", Min=1, Max=9, Unit="NoUnit")  % Input axis for HMI manual fan setting 1-9. [-]
AxisFanSetLvlForAirFlowPartDurgHmiManForRowFirst1 = AUTOSAR4.Parameter([1 2 3 4 5 6 7 8 9], DoubleProperty=0, Int32Property=int32(0), LogicalProperty=false, OnOffStringProperty="off", ColorStringProperty="red", StorageClass="CalData", MemorySection="CCM_CAL", DataType="VCCUInt8", Min=1, Max=9, Unit="NoUnit")  % Input axis for HMI manual fan setting 1-9. [-]
AxisFanSetLvlForAirFlowPartDurgHmiManForRowSec = AUTOSAR4.Parameter([1 2 3 4 5 6 7 8 9], DoubleProperty=0, Int32Property=int32(0), LogicalProperty=false, OnOffStringProperty="off", ColorStringProperty="red", StorageClass="CalData", MemorySection="CCM_CAL", DataType="VCCUInt8", Min=1, Max=9, Unit="NoUnit")  % Input axis for HMI manual fan setting 1-9. [-]
AxisFanSetLvlForCmftTotFlowForFanSetLvlAut = AUTOSAR4.Parameter([-2 -1 0 1 2], DoubleProperty=0, Int32Property=int32(0), LogicalProperty=false, OnOffStringProperty="off", ColorStringProperty="red", StorageClass="CalData", MemorySection="CCM_CAL", DataType="VCCInt16", Min=-2, Max=2, Unit="NoUnit")  % Axis for input of auto fan level, (-2=Auto--, -1=Auto-,0=Auto Normal, 1=Auto+, 2=Auto++). [-]
AxisFanSetLvlForFanSpdReqForClimaCtrlMan = AUTOSAR4.Parameter([1 2 3 4 5 6 7 8 9], DoubleProperty=0, Int32Property=int32(0), LogicalProperty=false, OnOffStringProperty="off", ColorStringProperty="red", StorageClass="CalData", MemorySection="CCM_CAL", DataType="VCCUInt8", Min=1, Max=9, Unit="NoUnit")  % Input axis for HMI manual fan setting 1-9 for MCC fan speed request. [-]
AxisForAirFlowTotDurgCnvincModActvForRowFirst = AUTOSAR4.Parameter([-2 -1 0 1 2 3], DoubleProperty=0, Int32Property=int32(0), LogicalProperty=false, OnOffStringProperty="off", ColorStringProperty="red", StorageClass="CalData", MemorySection="CCM_CAL", DataType="VCCInt16", Min=-2, Max=3, Unit="NoUnit")  % Axis for input of auto fan level, (-2=Auto--, -1=Auto-,0=Auto Normal, 1=Auto+, 2=Auto++, 3=Max). [-]
AxisForFatigLvlFacAirFlowAdjmt = AUTOSAR4.Parameter([0 1 2], DoubleProperty=0, Int32Property=int32(0), LogicalProperty=false, OnOffStringProperty="off", ColorStringProperty="red", StorageClass="CalData", MemorySection="CCM_CAL", DataType="VCCInt16", Min=0, Max=6, Unit="NoUnit")  % Axis for fatigue level required factor of  air flow.
AxisForTiLimForHexLowFlowLimAdjmtOfTotFlow = AUTOSAR4.Parameter([-30 -10 0 10 20], DoubleProperty=0, Int32Property=int32(0), LogicalProperty=false, OnOffStringProperty="off", ColorStringProperty="red", StorageClass="CalData", MemorySection="CCM_CAL", DataType="VCCT30", Min=-50, Max=80, Unit="DegCgrd")  % Axis of Time limit for low hex temperature for ClimaAdjmtOfTotFlowMgr
AxisHeatrAirTForCmftTotFlowLimDurgHeatAvlLo = AUTOSAR4.Parameter([10 20 30 40 50 60 70], DoubleProperty=0, Int32Property=int32(0), LogicalProperty=false, OnOffStringProperty="off", ColorStringProperty="red", StorageClass="CalData", MemorySection="CCM_CAL", DataType="VCCT30", Min=-50, Max=120, Unit="DegCgrd")  % Input axis for estimated hex temp for total airflow limit at low hex temp.
AxisMaxTiLimForHexLowFlowLimAdjmtOfTotFlow = AUTOSAR4.Parameter([-30 -10 0 10 20], DoubleProperty=0, Int32Property=int32(0), LogicalProperty=false, OnOffStringProperty="off", ColorStringProperty="red", StorageClass="CalData", MemorySection="CCM_CAL", DataType="VCCT30", Min=-50, Max=80, Unit="DegCgrd")  % Axis of Time limit for low hex temperature for ClimaAdjmtOfTotFlowMgr
AxisModDialAirMFlowReqMaxDriveForManMod = AUTOSAR4.Parameter([0 1 2 3 4 5 6 7], DoubleProperty=0, Int32Property=int32(0), LogicalProperty=false, OnOffStringProperty="off", ColorStringProperty="red", StorageClass="CalData", MemorySection="CCM_CAL", DataType="VCCUInt8", Min=0, Max=9, Unit="NoUnit")  % Max airflow in hvac for driver for mod dial for input ClimaManModMgr.
AxisTModForAirFlowScaForManDistbn = AUTOSAR4.Parameter([-20 -10 0 5 10 15 20], DoubleProperty=0, Int32Property=int32(0), LogicalProperty=false, OnOffStringProperty="off", ColorStringProperty="red", StorageClass="CalData", MemorySection="CCM_CAL", DataType="T31", Min=-40, Max=50, Unit="NoUnit")  % Input axis for mode temp for manual mode airflow scale. [DegC]
AxisTiLimForHexLowFlowLimAdjmtOfTotFlowDefrstFlr = AUTOSAR4.Parameter([-30 -10 0 10 20], DoubleProperty=0, Int32Property=int32(0), LogicalProperty=false, OnOffStringProperty="off", ColorStringProperty="red", StorageClass="CalData", MemorySection="CCM_CAL", DataType="VCCT30", Min=-50, Max=80, Unit="DegCgrd")  % Axis of Time limit for low hex temperature for ClimaAdjmtOfTotFlowMgr
ClimaCtrlUnit = Simulink.Parameter(1, StorageClass="Define", DataType="uint8")  % ECC=1 ETC=3 UAC=4
ClimaManModMgr_Runnable_Period = 0.2
ClimaManModMgr_timingEvent_0_2 = uint8(1)

CmftTotFlowLimDurgHeatAvlLoForHvacLvl2 = AUTOSAR4.Parameter([110 110 110 110 110
 110 110 110 110 110
 110 110 110 110 110
 165 165 165 165 165
 245 245 245 275 295
 310 310 310 340 400
 550 550 550 550 550], DoubleProperty=0, Int32Property=int32(0), LogicalProperty=false, OnOffStringProperty="off", ColorStringProperty="red", StorageClass="CalData", MemorySection="CCM_CAL", DataType="AirFlow30", Min=0, Max=1000, Unit="KgPerHour")  % Airflow limit due to low available heat for 2 zone HVAC.

CmftTotFlowLimDurgHeatAvlLoForHvacLvl2DurgHeatUp = AUTOSAR4.Parameter([110 110 110 110 110
 110 110 110 110 110
 110 110 110 110 110
 165 165 165 165 165
 245 245 245 275 295
 310 310 310 340 400
 550 550 550 550 550], DoubleProperty=0, Int32Property=int32(0), LogicalProperty=false, OnOffStringProperty="off", ColorStringProperty="red", StorageClass="CalData", MemorySection="CCM_CAL", DataType="AirFlow30", Min=0, Max=1000, Unit="KgPerHour")  % Airflow limit due to low available heat for 2 zone HVAC during heat-up state.

CmftTotFlowLimDurgHeatAvlLoForHvacLvl4 = AUTOSAR4.Parameter([110 110 110 110 110
 110 110 110 110 110
 110 110 110 110 110
 175 175 175 175 175
 265 265 265 285 305
 340 340 340 380 450
 550 550 550 550 550], DoubleProperty=0, Int32Property=int32(0), LogicalProperty=false, OnOffStringProperty="off", ColorStringProperty="red", StorageClass="CalData", MemorySection="CCM_CAL", DataType="AirFlow30", Min=0, Max=1000, Unit="KgPerHour")  % Airflow limit due to low available heat for 4 zone HVAC.

CmftTotFlowLimDurgHeatAvlLoForHvacLvl4DurgHeatUp = AUTOSAR4.Parameter([110 110 110 110 110
 110 110 110 110 110
 110 110 110 110 110
 175 175 175 175 175
 265 265 265 285 305
 340 340 340 380 450
 550 550 550 550 550], DoubleProperty=0, Int32Property=int32(0), LogicalProperty=false, OnOffStringProperty="off", ColorStringProperty="red", StorageClass="CalData", MemorySection="CCM_CAL", DataType="AirFlow30", Min=0, Max=1000, Unit="KgPerHour")  % Airflow limit due to low available heat for 4 zone HVAC during heat-up state.

CmptmtTFrntHiLimOffForManAirFlowNvh = AUTOSAR4.Parameter(25, DoubleProperty=0, Int32Property=int32(0), LogicalProperty=false, OnOffStringProperty="off", ColorStringProperty="red", StorageClass="CalData", MemorySection="CCM_CAL", DataType="TForCmptmt", Min=-20, Max=50, Unit="DegCgrd")  % Compartment front temperature high limit switch off for manul air flow NVH requirements.
CmptmtTFrntHiLimOnForManAirFlowNvh = AUTOSAR4.Parameter(27, DoubleProperty=0, Int32Property=int32(0), LogicalProperty=false, OnOffStringProperty="off", ColorStringProperty="red", StorageClass="CalData", MemorySection="CCM_CAL", DataType="TForCmptmt", Min=-20, Max=50, Unit="DegCgrd")  % Compartment front temperature high limit switch on for manul air flow NVH requirements.
CmptmtTFrntLoLimOffForManAirFlowNvh = AUTOSAR4.Parameter(6, DoubleProperty=0, Int32Property=int32(0), LogicalProperty=false, OnOffStringProperty="off", ColorStringProperty="red", StorageClass="CalData", MemorySection="CCM_CAL", DataType="TForCmptmt", Min=-20, Max=50, Unit="DegCgrd")  % Compartment front temperature low limit switch off for manul air flow NVH requirements.
CmptmtTFrntLoLimOnForManAirFlowNvh = AUTOSAR4.Parameter(8, DoubleProperty=0, Int32Property=int32(0), LogicalProperty=false, OnOffStringProperty="off", ColorStringProperty="red", StorageClass="CalData", MemorySection="CCM_CAL", DataType="TForCmptmt", Min=-20, Max=50, Unit="DegCgrd")  % Compartment front temperature low limit switch on for manul air flow NVH requirements.
ConTotFlowLimDurgRunngStb = AUTOSAR4.Parameter(250, DoubleProperty=0, Int32Property=int32(0), LogicalProperty=false, OnOffStringProperty="off", ColorStringProperty="red", StorageClass="CalData", MemorySection="CCM_CAL", DataType="AirFlow30", Min=0, Max=750, Unit="KgPerHour")  % Max front HVAC airflow during running standby and power level low.
CooltTHiLimForPosnModForClimaCtrlMan = AUTOSAR4.Parameter(40, DoubleProperty=0, Int32Property=int32(0), LogicalProperty=false, OnOffStringProperty="off", ColorStringProperty="red", StorageClass="CalData", MemorySection="CCM_CAL", DataType="VCCT30", Min=-40, Max=80, Unit="DegCgrd")  % Coolant temperature limit for use of high temperature calibration. [Deg C]
CooltTLimForFanSpdReqForClimaCtrlManDurgPreCdng = AUTOSAR4.Parameter(30, DoubleProperty=0, Int32Property=int32(0), LogicalProperty=false, OnOffStringProperty="off", ColorStringProperty="red", StorageClass="CalData", MemorySection="CCM_CAL", DataType="VCCT30", Min=-40, Max=80, Unit="DegCgrd")  % Coolant temperature limit for fan speed request for MCC during preconditioning. [Deg C]
CooltTLimHysForFanSpdReqForClimaCtrlManDurgPreCdng = AUTOSAR4.Parameter(5, DoubleProperty=0, Int32Property=int32(0), LogicalProperty=false, OnOffStringProperty="off", ColorStringProperty="red", StorageClass="CalData", MemorySection="CCM_CAL", DataType="VCCT30", Min=-40, Max=80, Unit="DegCgrd")  % Coolant temperature limit hysteresis for fan speed request for MCC during preconditioning. [Deg C]
CooltTLoLimForPosnModForClimaCtrlMan = AUTOSAR4.Parameter(10, DoubleProperty=0, Int32Property=int32(0), LogicalProperty=false, OnOffStringProperty="off", ColorStringProperty="red", StorageClass="CalData", MemorySection="CCM_CAL", DataType="VCCT30", Min=-40, Max=80, Unit="DegCgrd")  % Coolant temperature limit for use of low temperature calibration. [Deg C]
DataTypLimHiForCarTiGlb = Simulink.Parameter(429496729.5, StorageClass="Define", DataType="CarTiGlb")  % Maximum limit for defined data type
DataTypLimHiForFac30 = Simulink.Parameter(1.99993, StorageClass="Define", DataType="Fac30")  % Maximum limit for defined data type
DataTypLimHiForT30 = Simulink.Parameter(127.99609375, StorageClass="Define", DataType="T30")  % Maximum limit for defined data type
DataTypLimHiForTi33 = Simulink.Parameter(65535, StorageClass="Define", DataType="Ti33")  % Maximum limit for defined data type
DataTypLimHiForUint16 = Simulink.Parameter(65535, StorageClass="Define", DataType="uint16")  % Maximum limit for defined data type
DataTypLimHiForUint8 = Simulink.Parameter(255, StorageClass="Define", DataType="uint8")  % Maximum limit for defined data type
DataTypLimHiForVCCFac30 = Simulink.Parameter(1.99993, StorageClass="Define", DataType="VCCFac30")  % Maximum limit for defined data type
DataTypLimHiForVCCTi33 = Simulink.Parameter(65535, StorageClass="Define", DataType="VCCTi33")  % Maximum limit for defined data type
DataTypLimHiForVCCUInt16 = Simulink.Parameter(65535, StorageClass="Define", DataType="VCCUInt16")  % Maximum limit for defined data type
DataTypLimHiForVCCUInt32 = Simulink.Parameter(4294967295, StorageClass="Define", DataType="VCCUInt32")  % Maximum limit for defined data type
DataTypLimLoForCarTiGlb = Simulink.Parameter(0, StorageClass="Define", DataType="CarTiGlb")  % Minimum limit for defined data type
DataTypLimLoForFac30 = Simulink.Parameter(-2, StorageClass="Define", DataType="Fac30")  % Minimum limit for defined data type
DataTypLimLoForT30 = Simulink.Parameter(-128, StorageClass="Define", DataType="T30")  % Minimum limit for defined data type
DataTypLimLoForTi33 = Simulink.Parameter(0, StorageClass="Define", DataType="Ti33")  % Minimum limit for defined data type
DataTypLimLoForVCCFac30 = Simulink.Parameter(-2, StorageClass="Define", DataType="VCCFac30")  % Minimum limit for defined data type
DataTypLimLoForVCCTi33 = Simulink.Parameter(0, StorageClass="Define", DataType="VCCTi33")  % Minimum limit for defined data type
DataTypLimLoForVCCUInt32 = Simulink.Parameter(0, StorageClass="Define", DataType="VCCUInt32")  % Minimum limit for defined data type
DefrstMaxDistbnForDefrst = AUTOSAR4.Parameter(1, DoubleProperty=0, Int32Property=int32(0), LogicalProperty=false, OnOffStringProperty="off", ColorStringProperty="red", StorageClass="CalData", MemorySection="CCM_CAL", DataType="VCCFac30", Min=0, Max=1, Unit="NoUnit")  % Defroster part at max defroster for first row.
DefrstMaxDistbnForVent = AUTOSAR4.Parameter(0, DoubleProperty=0, Int32Property=int32(0), LogicalProperty=false, OnOffStringProperty="off", ColorStringProperty="red", StorageClass="CalData", MemorySection="CCM_CAL", DataType="VCCFac30", Min=0, Max=1, Unit="NoUnit")  % Vent part at max defroster for first row.
DefrstMaxDistbnForVentAtRowSec = AUTOSAR4.Parameter(1, DoubleProperty=0, Int32Property=int32(0), LogicalProperty=false, OnOffStringProperty="off", ColorStringProperty="red", StorageClass="CalData", MemorySection="CCM_CAL", DataType="VCCFac30", Min=0, Max=1, Unit="NoUnit")  % Vent part at max defroster for second row.
DiLoHexTempLimForHiReq = AUTOSAR4.Parameter(1, DoubleProperty=0, Int32Property=int32(0), LogicalProperty=false, OnOffStringProperty="off", ColorStringProperty="red", StorageClass="CalData", MemorySection="CCM_CAL", DataType="boolean", Min=0, Max=1, Unit="NoUnit")  % Disable low HEX temperature limit for Hi request for first.
EnManClimaFlowReqCorrdForManModForDefrstLe = AUTOSAR4.Parameter(0, DoubleProperty=0, Int32Property=int32(0), LogicalProperty=false, OnOffStringProperty="off", ColorStringProperty="red", StorageClass="CalData", MemorySection="CCM_CAL", DataType="boolean", Min=0, Max=1, Unit="NoUnit")  % Enable manual setting for ClimaFlowReqCorrdForManMod for defrost left.
EnManClimaFlowReqCorrdForManModForDefrstRi = AUTOSAR4.Parameter(0, DoubleProperty=0, Int32Property=int32(0), LogicalProperty=false, OnOffStringProperty="off", ColorStringProperty="red", StorageClass="CalData", MemorySection="CCM_CAL", DataType="boolean", Min=0, Max=1, Unit="NoUnit")  % Enable manual setting for ClimaFlowReqCorrdForManMod for defrost right.
EnManClimaFlowReqCorrdForManModForRowFirstAtFlrLe = AUTOSAR4.Parameter(0, DoubleProperty=0, Int32Property=int32(0), LogicalProperty=false, OnOffStringProperty="off", ColorStringProperty="red", StorageClass="CalData", MemorySection="CCM_CAL", DataType="boolean", Min=0, Max=1, Unit="NoUnit")  % Enable manual setting for ClimaFlowReqCorrdForManMod for row first at floor left.
EnManClimaFlowReqCorrdForManModForRowFirstAtFlrRi = AUTOSAR4.Parameter(0, DoubleProperty=0, Int32Property=int32(0), LogicalProperty=false, OnOffStringProperty="off", ColorStringProperty="red", StorageClass="CalData", MemorySection="CCM_CAL", DataType="boolean", Min=0, Max=1, Unit="NoUnit")  % Enable manual setting for ClimaFlowReqCorrdForManMod for row first at floor right.
EnManClimaFlowReqCorrdForManModForRowFirstAtVentLe = AUTOSAR4.Parameter(0, DoubleProperty=0, Int32Property=int32(0), LogicalProperty=false, OnOffStringProperty="off", ColorStringProperty="red", StorageClass="CalData", MemorySection="CCM_CAL", DataType="boolean", Min=0, Max=1, Unit="NoUnit")  % Enable manual setting for ClimaFlowReqCorrdForManMod for row first at vent left.
EnManClimaFlowReqCorrdForManModForRowFirstAtVentRi = AUTOSAR4.Parameter(0, DoubleProperty=0, Int32Property=int32(0), LogicalProperty=false, OnOffStringProperty="off", ColorStringProperty="red", StorageClass="CalData", MemorySection="CCM_CAL", DataType="boolean", Min=0, Max=1, Unit="NoUnit")  % Enable manual setting for ClimaFlowReqCorrdForManMod for row first at vent right.
EnManClimaFlowReqCorrdForManModForRowSecAtFlrLe = AUTOSAR4.Parameter(0, DoubleProperty=0, Int32Property=int32(0), LogicalProperty=false, OnOffStringProperty="off", ColorStringProperty="red", StorageClass="CalData", MemorySection="CCM_CAL", DataType="boolean", Min=0, Max=1, Unit="NoUnit")  % Enable manual setting for ClimaFlowReqCorrdForManMod for row first at floor left.
EnManClimaFlowReqCorrdForManModForRowSecAtFlrRi = AUTOSAR4.Parameter(0, DoubleProperty=0, Int32Property=int32(0), LogicalProperty=false, OnOffStringProperty="off", ColorStringProperty="red", StorageClass="CalData", MemorySection="CCM_CAL", DataType="boolean", Min=0, Max=1, Unit="NoUnit")  % Enable manual setting for ClimaFlowReqCorrdForManMod for row first at floor right.
EnManClimaFlowReqCorrdForManModForRowSecAtVentLe = AUTOSAR4.Parameter(0, DoubleProperty=0, Int32Property=int32(0), LogicalProperty=false, OnOffStringProperty="off", ColorStringProperty="red", StorageClass="CalData", MemorySection="CCM_CAL", DataType="boolean", Min=0, Max=1, Unit="NoUnit")  % Enable manual setting for ClimaFlowReqCorrdForManMod for row first at vent left.
EnManClimaFlowReqCorrdForManModForRowSecAtVentRi = AUTOSAR4.Parameter(0, DoubleProperty=0, Int32Property=int32(0), LogicalProperty=false, OnOffStringProperty="off", ColorStringProperty="red", StorageClass="CalData", MemorySection="CCM_CAL", DataType="boolean", Min=0, Max=1, Unit="NoUnit")  % Enable manual setting for ClimaFlowReqCorrdForManMod for row first at vent right.
EnManHvacAirMFlowReqMaxAvlForManMod = AUTOSAR4.Parameter(1, DoubleProperty=0, Int32Property=int32(0), LogicalProperty=false, OnOffStringProperty="off", ColorStringProperty="red", StorageClass="CalData", MemorySection="CCM_CAL", DataType="boolean", Min=0, Max=1, Unit="NoUnit")  % Enable manual setting for max airflow in hvac for input ClimaManModMgr.
EpsFlowLimOfClimaManModForDefrst = AUTOSAR4.Parameter(3, DoubleProperty=0, Int32Property=int32(0), LogicalProperty=false, OnOffStringProperty="off", ColorStringProperty="red", StorageClass="CalData", MemorySection="CCM_CAL", DataType="AirFlow30", Min=0, Max=20, Unit="KgPerHour")  % Hysteresis of airFlow high limit for defrost mode.
EpsTLimOfAirTFromHeatgEstimdManMod = AUTOSAR4.Parameter(5, DoubleProperty=0, Int32Property=int32(0), LogicalProperty=false, OnOffStringProperty="off", ColorStringProperty="red", StorageClass="CalData", MemorySection="CCM_CAL", DataType="VCCT30", Min=0, Max=10, Unit="DegCgrd")  % Hysteresis of temp limit of air temperature from hex.
EpsTLimOfClimaManModForAmbTLow = AUTOSAR4.Parameter(2, DoubleProperty=0, Int32Property=int32(0), LogicalProperty=false, OnOffStringProperty="off", ColorStringProperty="red", StorageClass="CalData", MemorySection="CCM_CAL", DataType="VCCT30", Min=-10, Max=10, Unit="DegCgrd")  % Hysteresis of temp limit for ambient temp is low.
FacScaForAirFlowManDurgDefrst = AUTOSAR4.Parameter(1, DoubleProperty=0, Int32Property=int32(0), LogicalProperty=false, OnOffStringProperty="off", ColorStringProperty="red", StorageClass="CalData", MemorySection="CCM_CAL", DataType="VCCFac30", Min=0, Max=1.99, Unit="NoUnit")  % Airflow scale factor for manual airflow during HMI air distribution Defrost. [-]
FacScaForAirFlowManDurgFlr = AUTOSAR4.Parameter(1, DoubleProperty=0, Int32Property=int32(0), LogicalProperty=false, OnOffStringProperty="off", ColorStringProperty="red", StorageClass="CalData", MemorySection="CCM_CAL", DataType="VCCFac30", Min=0, Max=1.99, Unit="NoUnit")  % Airflow scale factor for manual airflow during HMI air distribution Floor. [-]
FacScaForAirFlowManDurgFlrDefrst = AUTOSAR4.Parameter(1, DoubleProperty=0, Int32Property=int32(0), LogicalProperty=false, OnOffStringProperty="off", ColorStringProperty="red", StorageClass="CalData", MemorySection="CCM_CAL", DataType="VCCFac30", Min=0, Max=1.99, Unit="NoUnit")  % Airflow scale factor for manual airflow during HMI air distribution Floor/Defrost. [-]
FacScaForAirFlowManDurgFlrVent = AUTOSAR4.Parameter(1, DoubleProperty=0, Int32Property=int32(0), LogicalProperty=false, OnOffStringProperty="off", ColorStringProperty="red", StorageClass="CalData", MemorySection="CCM_CAL", DataType="VCCFac30", Min=0, Max=1.99, Unit="NoUnit")  % Airflow scale factor for manual airflow during HMI air distribution Floor/Vent. [-]
FacScaForAirFlowManDurgFlrVentDefrst = AUTOSAR4.Parameter(1, DoubleProperty=0, Int32Property=int32(0), LogicalProperty=false, OnOffStringProperty="off", ColorStringProperty="red", StorageClass="CalData", MemorySection="CCM_CAL", DataType="VCCFac30", Min=0, Max=1.99, Unit="NoUnit")  % Airflow scale factor for manual airflow during HMI air distribution Floor/Vent/Defrost. [-]
FacScaForAirFlowManDurgVent = AUTOSAR4.Parameter(1, DoubleProperty=0, Int32Property=int32(0), LogicalProperty=false, OnOffStringProperty="off", ColorStringProperty="red", StorageClass="CalData", MemorySection="CCM_CAL", DataType="VCCFac30", Min=0, Max=1.99, Unit="NoUnit")  % Airflow scale factor for manual airflow during HMI air distribution Vent. [-]
FacScaForAirFlowManDurgVentDefrst = AUTOSAR4.Parameter(1, DoubleProperty=0, Int32Property=int32(0), LogicalProperty=false, OnOffStringProperty="off", ColorStringProperty="red", StorageClass="CalData", MemorySection="CCM_CAL", DataType="VCCFac30", Min=0, Max=1.99, Unit="NoUnit")  % Airflow scale factor for manual airflow during HMI air distribution Vent/Defrost. [-]
FacScaForAirFlowManLvlForNvh = AUTOSAR4.Parameter(repmat(1, 1, 9), DoubleProperty=0, Int32Property=int32(0), LogicalProperty=false, OnOffStringProperty="off", ColorStringProperty="red", StorageClass="CalData", MemorySection="CCM_CAL", DataType="VCCFac30", Min=0, Max=1.99, Unit="NoUnit")  % Airflow scale factor for manual airflow level for NVH requirements. [-]
FanSpd1 = Simulink.AliasType(BaseType="uint16", HeaderFile="Rte_Type.h")
FanSpdMaxLimForPwrLvlLo = AUTOSAR4.Parameter(1700, DoubleProperty=0, Int32Property=int32(0), LogicalProperty=false, OnOffStringProperty="off", ColorStringProperty="red", StorageClass="CalData", MemorySection="CCM_CAL", DataType="VCCFanSpd1", Min=0, Max=4000, Unit="Rpm")  % Maximum requested fan speed during low power level. [rpm]
FanSpdReqForClimaCtrlMan = AUTOSAR4.Parameter([700 1000 1500 2000 2500 3000 3000 3000 3000], DoubleProperty=0, Int32Property=int32(0), LogicalProperty=false, OnOffStringProperty="off", ColorStringProperty="red", StorageClass="CalData", MemorySection="CCM_CAL", DataType="FanSpd1", Min=0, Max=5000, Unit="Rpm")  % Fan speed request for MCC during HMI fan manual level 1-9. [rpm]
FanSpdReqForClimaCtrlManDurgPreCdng = AUTOSAR4.Parameter(2000, DoubleProperty=0, Int32Property=int32(0), LogicalProperty=false, OnOffStringProperty="off", ColorStringProperty="red", StorageClass="CalData", MemorySection="CCM_CAL", DataType="FanSpd1", Min=0, Max=5000, Unit="Rpm")  % Fan speed request for MCC during preconditioning. [rpm]
FanSpdReqForClimaCtrlManForLvlMax = AUTOSAR4.Parameter(3000, DoubleProperty=0, Int32Property=int32(0), LogicalProperty=false, OnOffStringProperty="off", ColorStringProperty="red", StorageClass="CalData", MemorySection="CCM_CAL", DataType="FanSpd1", Min=0, Max=5000, Unit="Rpm")  % Fan speed request for MCC during HMI fan level Max. [rpm]
FanSpdReqForFanRCtrld = AUTOSAR4.Parameter(1500, DoubleProperty=0, Int32Property=int32(0), LogicalProperty=false, OnOffStringProperty="off", ColorStringProperty="red", StorageClass="CalData", MemorySection="CCM_CAL", DataType="FanSpd1", Min=0, Max=5000, Unit="Rpm")  % Dummy fan speed request for resistor controlled HVAC fan in MCC. [rpm]
FatigLvlFacAirFlowAdjmt = AUTOSAR4.Parameter([1 1 1 1 1; 1.1 1.1 1.1 1.1 1.1; 1.2 1.2 1.2 1.2 1.2], DoubleProperty=0, Int32Property=int32(0), LogicalProperty=false, OnOffStringProperty="off", ColorStringProperty="red", StorageClass="CalData", MemorySection="CCM_CAL", DataType="VCCFac30", Min=-2, Max=1.99994, Unit="NoUnit")  % PM2.5 level required factor of  air flow.
FctEnaForAirFlowScaForManMod = AUTOSAR4.Parameter(0, DoubleProperty=0, Int32Property=int32(0), LogicalProperty=false, OnOffStringProperty="off", ColorStringProperty="red", StorageClass="CalData", MemorySection="CCM_CAL", DataType="Boolean", Min=0, Max=1, Unit="NoUnit")  % Enable switch for scaling manual mode airflows. If set to false, airflow will be the same for manual modes and auto.
FctEnaForDeactvnOfAirFlowLimDurgPreCdngInNotHyb = AUTOSAR4.Parameter(0, DoubleProperty=0, Int32Property=int32(0), LogicalProperty=false, OnOffStringProperty="off", ColorStringProperty="red", StorageClass="CalData", MemorySection="CCM_CAL", DataType="Boolean", Min=0, Max=1, Unit="NoUnit")  % Switch to deactivate hextemp limit during preconditioning.
FctEnaForManModForRowSec = AUTOSAR4.Parameter(1, DoubleProperty=0, Int32Property=int32(0), LogicalProperty=false, OnOffStringProperty="off", ColorStringProperty="red", StorageClass="CalData", MemorySection="CCM_CAL", DataType="Boolean", Min=0, Max=1, Unit="NoUnit")  % Enable switch for manual modes on second row. If set to false, air distribution on second row will always be auto.
FlgOfOneFanZoneWithVGAFrntRow = AUTOSAR4.Parameter(0, DoubleProperty=0, Int32Property=int32(0), LogicalProperty=false, OnOffStringProperty="off", ColorStringProperty="red", StorageClass="CalData", MemorySection="CCM_CAL", DataType="Boolean", Min=0, Max=1, Unit="NoUnit")  % Flag of one fan level zone with VGA for first row
FlowForLvlMaxForRowFirst = AUTOSAR4.Parameter(500, DoubleProperty=0, Int32Property=int32(0), LogicalProperty=false, OnOffStringProperty="off", ColorStringProperty="red", StorageClass="CalData", MemorySection="CCM_CAL", DataType="AirFlow30", Min=0, Max=1000, Unit="KgPerHour")  % Flow request for HMI fan setting Max for first row. [kg/h]
FlowLimActvManModForStorg0 = AUTOSAR4.Signal(DoubleProperty=0, Int32Property=int32(0), LogicalProperty=false, OnOffStringProperty="off", ColorStringProperty="red", StorageClass="GlobalDisp", IsReusable=false, DataType="boolean", Min=0, Max=1, Unit="NoUnit", InitialValue="false")  % -
FlowLimActvManModForStorg1 = AUTOSAR4.Signal(DoubleProperty=0, Int32Property=int32(0), LogicalProperty=false, OnOffStringProperty="off", ColorStringProperty="red", StorageClass="GlobalDisp", IsReusable=false, DataType="boolean", Min=0, Max=1, Unit="NoUnit", InitialValue="false")  % -
FlowLimActvManModForStorg2 = AUTOSAR4.Signal(DoubleProperty=0, Int32Property=int32(0), LogicalProperty=false, OnOffStringProperty="off", ColorStringProperty="red", StorageClass="GlobalDisp", IsReusable=false, DataType="boolean", Min=0, Max=1, Unit="NoUnit", InitialValue="false")  % -
FlowLimActvManModForStorg3 = AUTOSAR4.Signal(DoubleProperty=0, Int32Property=int32(0), LogicalProperty=false, OnOffStringProperty="off", ColorStringProperty="red", StorageClass="GlobalDisp", IsReusable=false, DataType="boolean", Min=0, Max=1, Unit="NoUnit", InitialValue="false")  % -
FlowLimActvManModForStorg4 = AUTOSAR4.Signal(DoubleProperty=0, Int32Property=int32(0), LogicalProperty=false, OnOffStringProperty="off", ColorStringProperty="red", StorageClass="GlobalDisp", IsReusable=false, DataType="boolean", Min=0, Max=1, Unit="NoUnit", InitialValue="false")  % -

FlowLimForRowFirstDurgHeatrTLo = AUTOSAR4.Parameter([0 0 0 0 0
 0 0 0 0 0
 0 0 0 0 0
 20 20 20 20 20
 50 50 50 50 50
 90 90 90 90 90
 200 200 200 200 200], DoubleProperty=0, Int32Property=int32(0), LogicalProperty=false, OnOffStringProperty="off", ColorStringProperty="red", StorageClass="CalData", MemorySection="CCM_CAL", DataType="AirFlow30", Min=0, Max=750, Unit="KgPerHour")  % Airflow limit for first row floor/vent due to low available heat.

FlowLimForRowFirstDurgHeatrTLoDurgHeatUp = AUTOSAR4.Parameter([0 0 0 0 0
 0 0 0 0 0
 0 0 0 0 0
 20 20 20 20 20
 50 50 50 50 50
 90 90 90 90 90
 200 200 200 200 200], DoubleProperty=0, Int32Property=int32(0), LogicalProperty=false, OnOffStringProperty="off", ColorStringProperty="red", StorageClass="CalData", MemorySection="CCM_CAL", DataType="AirFlow30", Min=0, Max=750, Unit="KgPerHour")  % Airflow limit for first row floor/vent due to low available heat during heat-up.

FlowLimForRowSecDurgHeatrTLo = AUTOSAR4.Parameter([0 0 0 0 0
 0 0 0 0 0
 0 0 0 0 0
 20 20 20 20 20
 50 50 50 50 50
 90 90 90 90 90
 200 200 200 200 200], DoubleProperty=0, Int32Property=int32(0), LogicalProperty=false, OnOffStringProperty="off", ColorStringProperty="red", StorageClass="CalData", MemorySection="CCM_CAL", DataType="AirFlow30", Min=0, Max=750, Unit="KgPerHour")  % Airflow limit for second row floor/vent due to low available heat.

FlowLimForRowSecDurgHeatrTLoDurgHeatUp = AUTOSAR4.Parameter([0 0 0 0 0
 0 0 0 0 0
 0 0 0 0 0
 20 20 20 20 20
 50 50 50 50 50
 90 90 90 90 90
 200 200 200 200 200], DoubleProperty=0, Int32Property=int32(0), LogicalProperty=false, OnOffStringProperty="off", ColorStringProperty="red", StorageClass="CalData", MemorySection="CCM_CAL", DataType="AirFlow30", Min=0, Max=750, Unit="KgPerHour")  % Airflow limit for second row floor/vent due to low available heat during heat-up.

FlowLimOfClimaManModForDefrstHi = AUTOSAR4.Parameter(30, DoubleProperty=0, Int32Property=int32(0), LogicalProperty=false, OnOffStringProperty="off", ColorStringProperty="red", StorageClass="CalData", MemorySection="CCM_CAL", DataType="AirFlow30", Min=0, Max=100, Unit="KgPerHour")  % AirFlow high limit for defrost mode.
FlowLimOfClimaManModForDefrstLow = AUTOSAR4.Parameter(10, DoubleProperty=0, Int32Property=int32(0), LogicalProperty=false, OnOffStringProperty="off", ColorStringProperty="red", StorageClass="CalData", MemorySection="CCM_CAL", DataType="AirFlow30", Min=0, Max=100, Unit="KgPerHour")  % AirFlow low limit for defrost mode.
FlowReqForRowFirstAtFlrLeCnvincForStorg = AUTOSAR4.Signal(DoubleProperty=0, Int32Property=int32(0), LogicalProperty=false, OnOffStringProperty="off", ColorStringProperty="red", StorageClass="GlobalDisp", IsReusable=false, DataType="AirFlow30", Min=0, Max=1000, Unit="KgPerHour", InitialValue="0")  % -
FlowReqForRowFirstAtFlrLeDurgHiForStorg = AUTOSAR4.Signal(DoubleProperty=0, Int32Property=int32(0), LogicalProperty=false, OnOffStringProperty="off", ColorStringProperty="red", StorageClass="GlobalDisp", IsReusable=false, DataType="AirFlow30", Min=0, Max=1000, Unit="KgPerHour", InitialValue="0")  % -
FlowReqForRowFirstAtFlrLeDurgLoForStorg = AUTOSAR4.Signal(DoubleProperty=0, Int32Property=int32(0), LogicalProperty=false, OnOffStringProperty="off", ColorStringProperty="red", StorageClass="GlobalDisp", IsReusable=false, DataType="AirFlow30", Min=0, Max=1000, Unit="KgPerHour", InitialValue="0")  % -
FlowReqForRowFirstAtFlrLeManFanActvForStorg = AUTOSAR4.Signal(DoubleProperty=0, Int32Property=int32(0), LogicalProperty=false, OnOffStringProperty="off", ColorStringProperty="red", StorageClass="GlobalDisp", IsReusable=false, DataType="AirFlow30", Min=0, Max=1000, Unit="KgPerHour", InitialValue="0")  % -
FlowReqForRowFirstAtFlrLeMaxDefrstForStorg = AUTOSAR4.Signal(DoubleProperty=0, Int32Property=int32(0), LogicalProperty=false, OnOffStringProperty="off", ColorStringProperty="red", StorageClass="GlobalDisp", IsReusable=false, DataType="AirFlow30", Min=0, Max=1000, Unit="KgPerHour", InitialValue="0")  % -
FlowReqForRowFirstAtFlrLeMaxDefrstManForStorg = AUTOSAR4.Signal(DoubleProperty=0, Int32Property=int32(0), LogicalProperty=false, OnOffStringProperty="off", ColorStringProperty="red", StorageClass="GlobalDisp", IsReusable=false, DataType="AirFlow30", Min=0, Max=1000, Unit="KgPerHour", InitialValue="0")  % -
FlowReqForRowFirstAtFlrLePreClngForStorg = AUTOSAR4.Signal(DoubleProperty=0, Int32Property=int32(0), LogicalProperty=false, OnOffStringProperty="off", ColorStringProperty="red", StorageClass="GlobalDisp", IsReusable=false, DataType="AirFlow30", Min=0, Max=1000, Unit="KgPerHour", InitialValue="0")  % -
FlowReqForRowFirstAtFlrPwrAllwdLoForStorg = AUTOSAR4.Signal(DoubleProperty=0, Int32Property=int32(0), LogicalProperty=false, OnOffStringProperty="off", ColorStringProperty="red", StorageClass="GlobalDisp", IsReusable=false, DataType="AirFlow30", Min=0, Max=1000, Unit="KgPerHour", InitialValue="0")  % -
FlowReqScaForRowFirstAtFlrLeManDistbnForStorg = AUTOSAR4.Signal(DoubleProperty=0, Int32Property=int32(0), LogicalProperty=false, OnOffStringProperty="off", ColorStringProperty="red", StorageClass="GlobalDisp", IsReusable=false, DataType="AirFlow30", Min=0, Max=1000, Unit="KgPerHour", InitialValue="0")  % -
FlowStdDurgHiForRowFirst = AUTOSAR4.Parameter(400, DoubleProperty=0, Int32Property=int32(0), LogicalProperty=false, OnOffStringProperty="off", ColorStringProperty="red", StorageClass="CalData", MemorySection="CCM_CAL", DataType="AirFlow30", Min=0, Max=750, Unit="KgPerHour")  % Air flow level for Hi HMI setting for row first, at auto normal.
FlowStdDurgHiForRowFirstDurgRowSecOff = AUTOSAR4.Parameter(500, DoubleProperty=0, Int32Property=int32(0), LogicalProperty=false, OnOffStringProperty="off", ColorStringProperty="red", StorageClass="CalData", MemorySection="CCM_CAL", DataType="AirFlow30", Min=0, Max=750, Unit="KgPerHour")  % Air flow level for Hi HMI setting for row first, at auto normal when second row is present but off.
FlowStdDurgHiForRowSec = AUTOSAR4.Parameter(150, DoubleProperty=0, Int32Property=int32(0), LogicalProperty=false, OnOffStringProperty="off", ColorStringProperty="red", StorageClass="CalData", MemorySection="CCM_CAL", DataType="AirFlow30", Min=0, Max=750, Unit="KgPerHour")  % Air flow level for Hi HMI setting for row sec, at auto normal.
FlowStdDurgLoForRowFirst = AUTOSAR4.Parameter(400, DoubleProperty=0, Int32Property=int32(0), LogicalProperty=false, OnOffStringProperty="off", ColorStringProperty="red", StorageClass="CalData", MemorySection="CCM_CAL", DataType="AirFlow30", Min=0, Max=750, Unit="KgPerHour")  % Flow level for Lo HMI setting, at auto normal for first row.
FlowStdDurgLoForRowFirstDurgRowSecOff = AUTOSAR4.Parameter(500, DoubleProperty=0, Int32Property=int32(0), LogicalProperty=false, OnOffStringProperty="off", ColorStringProperty="red", StorageClass="CalData", MemorySection="CCM_CAL", DataType="AirFlow30", Min=0, Max=750, Unit="KgPerHour")  % Flow level for Lo HMI setting, at auto normal for first row when second row is present but off.
FlowStdDurgLoForRowSec = AUTOSAR4.Parameter(150, DoubleProperty=0, Int32Property=int32(0), LogicalProperty=false, OnOffStringProperty="off", ColorStringProperty="red", StorageClass="CalData", MemorySection="CCM_CAL", DataType="AirFlow30", Min=0, Max=750, Unit="KgPerHour")  % Flow level for Lo HMI setting, at auto normal for second row.
HvacAirMFlowReqMaxAvDrivelForManMod = AUTOSAR4.Parameter(repmat(50, 8, 5), DoubleProperty=0, Int32Property=int32(0), LogicalProperty=false, OnOffStringProperty="off", ColorStringProperty="red", StorageClass="CalData", MemorySection="CCM_CAL", DataType="AirFlow30", Min=0, Max=1000, Unit="KgPerHour")  % Max airflow in hvac for driver for input ClimaManModMgr.
HvacAirMFlowReqMaxAvlManForStorg = AUTOSAR4.Signal(DoubleProperty=0, Int32Property=int32(0), LogicalProperty=false, OnOffStringProperty="off", ColorStringProperty="red", StorageClass="GlobalDisp", IsReusable=false, DataType="AirFlow30", Min=0, Max=1000, Unit="KgPerHour", InitialValue="0")  % -
HvacFanSpdFrntMin = Simulink.Parameter(0, StorageClass="Define", DataType="VCCFanSpd1")  % Maximum limit for defined data type
IncRateMaxForAirTAftHvacDesForEv = AUTOSAR4.Parameter(repmat(2, 1, 5), DoubleProperty=0, Int32Property=int32(0), LogicalProperty=false, OnOffStringProperty="off", ColorStringProperty="red", StorageClass="CalData", MemorySection="CCM_CAL", DataType="VCCT30", Min=0, Max=50, Unit="DegCgrd")  % Maximum increase rate for desired air temperature after HVAC for EV.
IncRateMaxForAirTAftHvacDesForEvForEco = AUTOSAR4.Parameter(repmat(1, 1, 5), DoubleProperty=0, Int32Property=int32(0), LogicalProperty=false, OnOffStringProperty="off", ColorStringProperty="red", StorageClass="CalData", MemorySection="CCM_CAL", DataType="VCCT30", Min=0, Max=50, Unit="DegCgrd")  % Maximum increase rate for desired air temperature after HVAC for EV and ECO mode active.
IncRateMaxForAirTAftHvacDesForHybWithFuHeatr = AUTOSAR4.Parameter(repmat(0.5, 1, 5), DoubleProperty=0, Int32Property=int32(0), LogicalProperty=false, OnOffStringProperty="off", ColorStringProperty="red", StorageClass="CalData", MemorySection="CCM_CAL", DataType="VCCT30", Min=0, Max=50, Unit="DegCgrd")  % Maximum increase rate for desired air temperature after HVAC for hybrid with FOH.
IncRateMaxForAirTAftHvacDesForHybWithFuHeatrForEco = AUTOSAR4.Parameter(repmat(0.2, 1, 5), DoubleProperty=0, Int32Property=int32(0), LogicalProperty=false, OnOffStringProperty="off", ColorStringProperty="red", StorageClass="CalData", MemorySection="CCM_CAL", DataType="VCCT30", Min=0, Max=50, Unit="DegCgrd")  % Maximum increase rate for desired air temperature after HVAC for hybrid with FOH and ECO mode active.
IncRateMaxForAirTAftHvacDesForHybWithHvHeatr = AUTOSAR4.Parameter(repmat(2, 1, 5), DoubleProperty=0, Int32Property=int32(0), LogicalProperty=false, OnOffStringProperty="off", ColorStringProperty="red", StorageClass="CalData", MemorySection="CCM_CAL", DataType="VCCT30", Min=0, Max=50, Unit="DegCgrd")  % Maximum increase rate for desired air temperature after HVAC for hybrid with HVCH.
IncRateMaxForAirTAftHvacDesForHybWithHvHeatrForEco = AUTOSAR4.Parameter(repmat(1, 1, 5), DoubleProperty=0, Int32Property=int32(0), LogicalProperty=false, OnOffStringProperty="off", ColorStringProperty="red", StorageClass="CalData", MemorySection="CCM_CAL", DataType="VCCT30", Min=0, Max=50, Unit="DegCgrd")  % Maximum increase rate for desired air temperature after HVAC for hybrid with HVCH and ECO mode active.
IncRateMaxForAirTAftHvacDesForNotHyb = AUTOSAR4.Parameter(repmat(50, 1, 5), DoubleProperty=0, Int32Property=int32(0), LogicalProperty=false, OnOffStringProperty="off", ColorStringProperty="red", StorageClass="CalData", MemorySection="CCM_CAL", DataType="VCCT30", Min=0, Max=50, Unit="DegCgrd")  % Maximum increase rate for desired air temperature after HVAC for non hybrid.
IncRateMaxForAirTDesForEv = AUTOSAR4.Parameter(repmat(2, 1, 5), DoubleProperty=0, Int32Property=int32(0), LogicalProperty=false, OnOffStringProperty="off", ColorStringProperty="red", StorageClass="CalData", MemorySection="CCM_CAL", DataType="VCCT30", Min=0, Max=50, Unit="DegCgrd")  % Maximum increase rate for requested air temperature for EV.
IncRateMaxForAirTDesForEvForEco = AUTOSAR4.Parameter(repmat(1, 1, 5), DoubleProperty=0, Int32Property=int32(0), LogicalProperty=false, OnOffStringProperty="off", ColorStringProperty="red", StorageClass="CalData", MemorySection="CCM_CAL", DataType="VCCT30", Min=0, Max=50, Unit="DegCgrd")  % Maximum increase rate for requested air temperature for EV and ECO mode active.
IncRateMaxForAirTDesForHybWithFuHeatr = AUTOSAR4.Parameter(repmat(0.5, 1, 5), DoubleProperty=0, Int32Property=int32(0), LogicalProperty=false, OnOffStringProperty="off", ColorStringProperty="red", StorageClass="CalData", MemorySection="CCM_CAL", DataType="VCCT30", Min=0, Max=50, Unit="DegCgrd")  % Maximum increase rate for requested air temperature for hybrid with FOH.
IncRateMaxForAirTDesForHybWithFuHeatrForEco = AUTOSAR4.Parameter(repmat(0.2, 1, 5), DoubleProperty=0, Int32Property=int32(0), LogicalProperty=false, OnOffStringProperty="off", ColorStringProperty="red", StorageClass="CalData", MemorySection="CCM_CAL", DataType="VCCT30", Min=0, Max=50, Unit="DegCgrd")  % Maximum increase rate for requested air temperature for hybrid with FOH and ECO mode active.
IncRateMaxForAirTDesForHybWithHvHeatr = AUTOSAR4.Parameter(repmat(2, 1, 5), DoubleProperty=0, Int32Property=int32(0), LogicalProperty=false, OnOffStringProperty="off", ColorStringProperty="red", StorageClass="CalData", MemorySection="CCM_CAL", DataType="VCCT30", Min=0, Max=50, Unit="DegCgrd")  % Maximum increase rate for requested air temperature for hybrid with HVCH.
IncRateMaxForAirTDesForHybWithHvHeatrForEco = AUTOSAR4.Parameter(repmat(1, 1, 5), DoubleProperty=0, Int32Property=int32(0), LogicalProperty=false, OnOffStringProperty="off", ColorStringProperty="red", StorageClass="CalData", MemorySection="CCM_CAL", DataType="VCCT30", Min=0, Max=50, Unit="DegCgrd")  % Maximum increase rate for requested air temperature for hybrid with HVCH and ECO mode active.
IncRateMaxForAirTDesForNotHyb = AUTOSAR4.Parameter(repmat(50, 1, 5), DoubleProperty=0, Int32Property=int32(0), LogicalProperty=false, OnOffStringProperty="off", ColorStringProperty="red", StorageClass="CalData", MemorySection="CCM_CAL", DataType="VCCT30", Min=0, Max=50, Unit="DegCgrd")  % Maximum increase rate for requested air temperature for non hybrid.
LvlClimaCtrl = Simulink.Parameter(4, StorageClass="Define", DataType="uint8")  % Number of zones in car
MFlowMin = Simulink.Parameter(0, StorageClass="Define", DataType="MFlow1")
ManClimaFlowReqCorrdForManModForDefrstLe = AUTOSAR4.Parameter(0, DoubleProperty=0, Int32Property=int32(0), LogicalProperty=false, OnOffStringProperty="off", ColorStringProperty="red", StorageClass="CalData", MemorySection="CCM_CAL", DataType="AirFlow30", Min=0, Max=1000, Unit="KgPerHour")  % Manual setting for ClimaFlowReqCorrdForManMod for defrost left.
ManClimaFlowReqCorrdForManModForDefrstRi = AUTOSAR4.Parameter(0, DoubleProperty=0, Int32Property=int32(0), LogicalProperty=false, OnOffStringProperty="off", ColorStringProperty="red", StorageClass="CalData", MemorySection="CCM_CAL", DataType="AirFlow30", Min=0, Max=1000, Unit="KgPerHour")  % Manual setting for ClimaFlowReqCorrdForManMod for defrost right.
ManClimaFlowReqCorrdForManModForRowFirstAtFlrLe = AUTOSAR4.Parameter(0, DoubleProperty=0, Int32Property=int32(0), LogicalProperty=false, OnOffStringProperty="off", ColorStringProperty="red", StorageClass="CalData", MemorySection="CCM_CAL", DataType="AirFlow30", Min=0, Max=1000, Unit="KgPerHour")  % Manual setting for ClimaFlowReqCorrdForManMod for row first at floor left.
ManClimaFlowReqCorrdForManModForRowFirstAtFlrRi = AUTOSAR4.Parameter(0, DoubleProperty=0, Int32Property=int32(0), LogicalProperty=false, OnOffStringProperty="off", ColorStringProperty="red", StorageClass="CalData", MemorySection="CCM_CAL", DataType="AirFlow30", Min=0, Max=1000, Unit="KgPerHour")  % Manual setting for ClimaFlowReqCorrdForManMod for row first at floor right.
ManClimaFlowReqCorrdForManModForRowFirstAtVentLe = AUTOSAR4.Parameter(0, DoubleProperty=0, Int32Property=int32(0), LogicalProperty=false, OnOffStringProperty="off", ColorStringProperty="red", StorageClass="CalData", MemorySection="CCM_CAL", DataType="AirFlow30", Min=0, Max=1000, Unit="KgPerHour")  % Manual setting for ClimaFlowReqCorrdForManMod for row first at vent left.
ManClimaFlowReqCorrdForManModForRowFirstAtVentRi = AUTOSAR4.Parameter(0, DoubleProperty=0, Int32Property=int32(0), LogicalProperty=false, OnOffStringProperty="off", ColorStringProperty="red", StorageClass="CalData", MemorySection="CCM_CAL", DataType="AirFlow30", Min=0, Max=1000, Unit="KgPerHour")  % Manual setting for ClimaFlowReqCorrdForManMod for row first at vent right.
ManClimaFlowReqCorrdForManModForRowSecAtFlrLe = AUTOSAR4.Parameter(0, DoubleProperty=0, Int32Property=int32(0), LogicalProperty=false, OnOffStringProperty="off", ColorStringProperty="red", StorageClass="CalData", MemorySection="CCM_CAL", DataType="AirFlow30", Min=0, Max=1000, Unit="KgPerHour")  % Manual setting for ClimaFlowReqCorrdForManMod for row first at floor left.
ManClimaFlowReqCorrdForManModForRowSecAtFlrRi = AUTOSAR4.Parameter(0, DoubleProperty=0, Int32Property=int32(0), LogicalProperty=false, OnOffStringProperty="off", ColorStringProperty="red", StorageClass="CalData", MemorySection="CCM_CAL", DataType="AirFlow30", Min=0, Max=1000, Unit="KgPerHour")  % Manual setting for ClimaFlowReqCorrdForManMod for row first at floor right.
ManClimaFlowReqCorrdForManModForRowSecAtVentLe = AUTOSAR4.Parameter(0, DoubleProperty=0, Int32Property=int32(0), LogicalProperty=false, OnOffStringProperty="off", ColorStringProperty="red", StorageClass="CalData", MemorySection="CCM_CAL", DataType="AirFlow30", Min=0, Max=1000, Unit="KgPerHour")  % Manual setting for ClimaFlowReqCorrdForManMod for row first at vent left.
ManClimaFlowReqCorrdForManModForRowSecAtVentRi = AUTOSAR4.Parameter(0, DoubleProperty=0, Int32Property=int32(0), LogicalProperty=false, OnOffStringProperty="off", ColorStringProperty="red", StorageClass="CalData", MemorySection="CCM_CAL", DataType="AirFlow30", Min=0, Max=1000, Unit="KgPerHour")  % Manual setting for ClimaFlowReqCorrdForManMod for row first at vent right.
ManEnaForActrPosnReqForModDistbnForClimaCtrlMan = AUTOSAR4.Parameter(1, DoubleProperty=0, Int32Property=int32(0), LogicalProperty=false, OnOffStringProperty="off", ColorStringProperty="red", StorageClass="CalData", MemorySection="CCM_CAL", DataType="boolean", Min=0, Max=1, Unit="NoUnit")  % Enable manual mode distribution actuator position for MCC.
ManEnaForHvacFanSpdReqFrntForClimaCtrlMan = AUTOSAR4.Parameter(1, DoubleProperty=0, Int32Property=int32(0), LogicalProperty=false, OnOffStringProperty="off", ColorStringProperty="red", StorageClass="CalData", MemorySection="CCM_CAL", DataType="boolean", Min=0, Max=1, Unit="NoUnit")  % Enable manual fan speed request for resistor controlled HVAC fan in MCC.
ManHvacAirMFlowReqMaxAvlForManMod = AUTOSAR4.Parameter(50, DoubleProperty=0, Int32Property=int32(0), LogicalProperty=false, OnOffStringProperty="off", ColorStringProperty="red", StorageClass="CalData", MemorySection="CCM_CAL", DataType="AirFlow30", Min=0, Max=1000, Unit="KgPerHour")  % Manual setting for max airflow in hvac for input ClimaManModMgr.
ManModHexFlowLimActvForStorg = AUTOSAR4.Signal(DoubleProperty=0, Int32Property=int32(0), LogicalProperty=false, OnOffStringProperty="off", ColorStringProperty="red", StorageClass="GlobalDisp", IsReusable=false, DataType="boolean", InitialValue="false")
ManModHmiAirDistbnFrntLeForStorg = AUTOSAR4.Signal(DoubleProperty=0, Int32Property=int32(0), LogicalProperty=false, OnOffStringProperty="off", ColorStringProperty="red", StorageClass="GlobalDisp", IsReusable=false, DataType="Enum:HmiCmptmtAirDistbnFrnt", InitialValue="HmiCmptmtAirDistbnFrnt.Flr")
ManModHmiAirDistbnFrntRiForStorg = AUTOSAR4.Signal(DoubleProperty=0, Int32Property=int32(0), LogicalProperty=false, OnOffStringProperty="off", ColorStringProperty="red", StorageClass="GlobalDisp", IsReusable=false, DataType="Enum:HmiCmptmtAirDistbnFrnt", InitialValue="HmiCmptmtAirDistbnFrnt.Flr")
ManValForActrPosnReqForModDistbnForClimaCtrlMan = AUTOSAR4.Parameter(0, DoubleProperty=0, Int32Property=int32(0), LogicalProperty=false, OnOffStringProperty="off", ColorStringProperty="red", StorageClass="CalData", MemorySection="CCM_CAL", DataType="Perc30", Min=0, Max=100, Unit="Perc")  % Manual mode distribution actuator position for MCC. [Perc]
ManValForHvacFanSpdReqFrntForClimaCtrlMan = AUTOSAR4.Parameter(0, DoubleProperty=0, Int32Property=int32(0), LogicalProperty=false, OnOffStringProperty="off", ColorStringProperty="red", StorageClass="CalData", MemorySection="CCM_CAL", DataType="FanSpd1", Min=0, Max=5000, Unit="Rpm")  % Manual fan speed request for resistor controlled HVAC fan in MCC. [rpm]
MaxTiLimForHexLowFlowLimAdjmtOfTotFlow = AUTOSAR4.Parameter(repmat(900, 1, 5), DoubleProperty=0, Int32Property=int32(0), LogicalProperty=false, OnOffStringProperty="off", ColorStringProperty="red", StorageClass="CalData", MemorySection="CCM_CAL", DataType="VCCTi33", Min=0, Max=3600, Unit="Sec")  % Time limit for low hex temperature for ClimaAdjmtOfTotFlowMgr
ModeDialDefrstFlrInForHexDefrstForStorg = AUTOSAR4.Signal(DoubleProperty=0, Int32Property=int32(0), LogicalProperty=false, OnOffStringProperty="off", ColorStringProperty="red", StorageClass="GlobalDisp", IsReusable=false, DataType="boolean", Min=0, Max=1, Unit="NoUnit", InitialValue="false")  % -
ModeDialDefrstFlrInForHexFlrDefrstForStorg = AUTOSAR4.Signal(DoubleProperty=0, Int32Property=int32(0), LogicalProperty=false, OnOffStringProperty="off", ColorStringProperty="red", StorageClass="GlobalDisp", IsReusable=false, DataType="boolean", Min=0, Max=1, Unit="NoUnit", InitialValue="false")  % -
ModeDialDefrstFlrInForTiDefrstForStorg = AUTOSAR4.Signal(DoubleProperty=0, Int32Property=int32(0), LogicalProperty=false, OnOffStringProperty="off", ColorStringProperty="red", StorageClass="GlobalDisp", IsReusable=false, DataType="boolean", Min=0, Max=1, Unit="NoUnit", InitialValue="false")  % -
ModeDialDefrstFlrInForTiFlrDefrstForStorg = AUTOSAR4.Signal(DoubleProperty=0, Int32Property=int32(0), LogicalProperty=false, OnOffStringProperty="off", ColorStringProperty="red", StorageClass="GlobalDisp", IsReusable=false, DataType="boolean", Min=0, Max=1, Unit="NoUnit", InitialValue="false")  % -
ModeDialDefrstFlrOutForStorg = AUTOSAR4.Signal(DoubleProperty=0, Int32Property=int32(0), LogicalProperty=false, OnOffStringProperty="off", ColorStringProperty="red", StorageClass="GlobalDisp", IsReusable=false, DataType="Enum:HmiCmptmtAirDistbnFrnt", InitialValue="HmiCmptmtAirDistbnFrnt.Flr")
MtrPerSecToKiloMtrPerHour = Simulink.Parameter(3.6, StorageClass="Define", DataType="Spd37")  % Conversion factor for meter per second to kilometer per hour
NeEpsFlowLimOfClimaManModForDefrst = AUTOSAR4.Parameter(-3, DoubleProperty=0, Int32Property=int32(0), LogicalProperty=false, OnOffStringProperty="off", ColorStringProperty="red", StorageClass="CalData", MemorySection="CCM_CAL", DataType="AirFlow30", Min=-20, Max=0, Unit="KgPerHour")  % Hysteresis of airFlow high limit for defrost mode.
NeEpsTLimOfAirTFromHeatgEstimdManMod = AUTOSAR4.Parameter(-5, DoubleProperty=0, Int32Property=int32(0), LogicalProperty=false, OnOffStringProperty="off", ColorStringProperty="red", StorageClass="CalData", MemorySection="CCM_CAL", DataType="VCCT30", Min=-10, Max=0, Unit="DegCgrd")  % Hysteresis of temp limit of air temperature from hex.
NeEpsTLimOfClimaManModForAmbTLow = AUTOSAR4.Parameter(-2, DoubleProperty=0, Int32Property=int32(0), LogicalProperty=false, OnOffStringProperty="off", ColorStringProperty="red", StorageClass="CalData", MemorySection="CCM_CAL", DataType="VCCT30", Min=-10, Max=10, Unit="DegCgrd")  % Hysteresis of temp limit for ambient temperature is low.
NrOfSampleForPwrCnsEstimn = Simulink.Parameter(20, StorageClass="Define", DataType="VCCUInt8")  % Number of samples for averaging of seat power consumption.
OneForVCCUInt16 = Simulink.Parameter(1, StorageClass="Define", DataType="VCCUInt16")  % One for defined data type
PartForDefrstAtLo = AUTOSAR4.Parameter(0, DoubleProperty=0, Int32Property=int32(0), LogicalProperty=false, OnOffStringProperty="off", ColorStringProperty="red", StorageClass="CalData", MemorySection="CCM_CAL", DataType="VCCFac30", Min=0, Max=1, Unit="NoUnit")  % Defroster air distribution at Lo setting for row first
PartForDefrstDurgDefrst = AUTOSAR4.Parameter([0.633 0.625 0.618 0.629 0.837 0.835 0.834 0.833 0.829 0.826], DoubleProperty=0, Int32Property=int32(0), LogicalProperty=false, OnOffStringProperty="off", ColorStringProperty="red", StorageClass="CalData", MemorySection="CCM_CAL", DataType="VCCFac30", Min=0, Max=1, Unit="NoUnit")  % Preferred Defroster part when manual Defroster is selected.
PartForDefrstDurgDefrstForHeatUp = AUTOSAR4.Parameter([0.848 0.845 0.842 0.84 0.837 0.835 0.834 0.833 0.829 0.826], DoubleProperty=0, Int32Property=int32(0), LogicalProperty=false, OnOffStringProperty="off", ColorStringProperty="red", StorageClass="CalData", MemorySection="CCM_CAL", DataType="VCCFac30", Min=0, Max=1, Unit="NoUnit")  % Preferred Defroster part during heat-up phase when manual Defroster is selected.
PartForDefrstDurgFlr = AUTOSAR4.Parameter([0.19 0.173 0.158 0.154 0.147 0.043 0.042 0.042 0.041 0.04], DoubleProperty=0, Int32Property=int32(0), LogicalProperty=false, OnOffStringProperty="off", ColorStringProperty="red", StorageClass="CalData", MemorySection="CCM_CAL", DataType="VCCFac30", Min=0, Max=1, Unit="NoUnit")  % Preferred Defroster part when manual Floor is selected.
PartForDefrstDurgFlrDefrst = AUTOSAR4.Parameter([0.517 0.505 0.488 0.471 0.464 0.432 0.442 0.482 0.474 0.468], DoubleProperty=0, Int32Property=int32(0), LogicalProperty=false, OnOffStringProperty="off", ColorStringProperty="red", StorageClass="CalData", MemorySection="CCM_CAL", DataType="VCCFac30", Min=0, Max=1, Unit="NoUnit")  % Preferred Defroster part when manual Defroster and Floor are selected.
PartForDefrstDurgVent = AUTOSAR4.Parameter([0.114 0.11 0.106 0.03 0.03 0.029 0.029 0.028 0.027 0.026], DoubleProperty=0, Int32Property=int32(0), LogicalProperty=false, OnOffStringProperty="off", ColorStringProperty="red", StorageClass="CalData", MemorySection="CCM_CAL", DataType="VCCFac30", Min=0, Max=1, Unit="NoUnit")  % Preferred Defroster part when manual Vent is selected.
PartForDefrstDurgVentDefrst = AUTOSAR4.Parameter([0.38 0.366 0.355 0.359 0.351 0.346 0.342 0.338 0.326 0.317], DoubleProperty=0, Int32Property=int32(0), LogicalProperty=false, OnOffStringProperty="off", ColorStringProperty="red", StorageClass="CalData", MemorySection="CCM_CAL", DataType="VCCFac30", Min=0, Max=1, Unit="NoUnit")  % Preferred Defroster part when manual Vent and Defroster are selected.
PartForDefrstDurgVentDefrstForHeatUp = AUTOSAR4.Parameter([0.388 0.377 0.368 0.359 0.351 0.346 0.342 0.338 0.326 0.317], DoubleProperty=0, Int32Property=int32(0), LogicalProperty=false, OnOffStringProperty="off", ColorStringProperty="red", StorageClass="CalData", MemorySection="CCM_CAL", DataType="VCCFac30", Min=0, Max=1, Unit="NoUnit")  % Preferred Defroster part during heat-up phase when manual Vent and Defroster are selected.
PartForDefrstDurgVentFlr = AUTOSAR4.Parameter([0.101 0.097 0.094 0.09 0.083 0.025 0.025 0.025 0.024 0.023], DoubleProperty=0, Int32Property=int32(0), LogicalProperty=false, OnOffStringProperty="off", ColorStringProperty="red", StorageClass="CalData", MemorySection="CCM_CAL", DataType="VCCFac30", Min=0, Max=1, Unit="NoUnit")  % Preferred Defroster part when manual Vent and Floor are selected.
PartForDefrstDurgVentFlrDefrst = AUTOSAR4.Parameter([0.481 0.468 0.443 0.397 0.331 0.275 0.253 0.249 0.234 0.225], DoubleProperty=0, Int32Property=int32(0), LogicalProperty=false, OnOffStringProperty="off", ColorStringProperty="red", StorageClass="CalData", MemorySection="CCM_CAL", DataType="VCCFac30", Min=0, Max=1, Unit="NoUnit")  % Preferred Defroster part when manual Vent, Defroster and Floor are selected.
PartForDefrstDurgVentForHeatUp = AUTOSAR4.Parameter([0.114 0.11 0.107 0.03 0.03 0.029 0.029 0.028 0.027 0.026], DoubleProperty=0, Int32Property=int32(0), LogicalProperty=false, OnOffStringProperty="off", ColorStringProperty="red", StorageClass="CalData", MemorySection="CCM_CAL", DataType="VCCFac30", Min=0, Max=1, Unit="NoUnit")  % Preferred Defroster part during heat-up phase when manual Vent is selected
PartForDefrstForRowSecDurgDefrst = AUTOSAR4.Parameter([0.633 0.625 0.618 0.629 0.837 0.835 0.834 0.833 0.829 0.826], DoubleProperty=0, Int32Property=int32(0), LogicalProperty=false, OnOffStringProperty="off", ColorStringProperty="red", StorageClass="CalData", MemorySection="CCM_CAL", DataType="VCCFac30", Min=0, Max=1, Unit="NoUnit")  % Preferred Defroster part at second row when manual Defroster is selected.
PartForDefrstForRowSecDurgDefrstForHeatUp = AUTOSAR4.Parameter([0.848 0.845 0.842 0.84 0.837 0.835 0.834 0.833 0.829 0.826], DoubleProperty=0, Int32Property=int32(0), LogicalProperty=false, OnOffStringProperty="off", ColorStringProperty="red", StorageClass="CalData", MemorySection="CCM_CAL", DataType="VCCFac30", Min=0, Max=1, Unit="NoUnit")  % Preferred Defroster part at second row during heat-up phase when manual Defroster is selected.
PartForDefrstForRowSecDurgFlr = AUTOSAR4.Parameter([0.19 0.173 0.158 0.154 0.147 0.043 0.042 0.042 0.041 0.04], DoubleProperty=0, Int32Property=int32(0), LogicalProperty=false, OnOffStringProperty="off", ColorStringProperty="red", StorageClass="CalData", MemorySection="CCM_CAL", DataType="VCCFac30", Min=0, Max=1, Unit="NoUnit")  % Preferred Defroster part at second row when manual Floor is selected.
PartForDefrstForRowSecDurgFlrDefrst = AUTOSAR4.Parameter([0.517 0.505 0.488 0.471 0.464 0.432 0.442 0.482 0.474 0.468], DoubleProperty=0, Int32Property=int32(0), LogicalProperty=false, OnOffStringProperty="off", ColorStringProperty="red", StorageClass="CalData", MemorySection="CCM_CAL", DataType="VCCFac30", Min=0, Max=1, Unit="NoUnit")  % Preferred Defroster part at second row when manual Defroster and Floor are selected.
PartForDefrstForRowSecDurgVent = AUTOSAR4.Parameter([0.114 0.11 0.106 0.03 0.03 0.029 0.029 0.028 0.027 0.026], DoubleProperty=0, Int32Property=int32(0), LogicalProperty=false, OnOffStringProperty="off", ColorStringProperty="red", StorageClass="CalData", MemorySection="CCM_CAL", DataType="VCCFac30", Min=0, Max=1, Unit="NoUnit")  % Preferred Defroster part at second row when manual Vent is selected.
PartForDefrstForRowSecDurgVentDefrst = AUTOSAR4.Parameter([0.38 0.366 0.355 0.359 0.351 0.346 0.342 0.338 0.326 0.317], DoubleProperty=0, Int32Property=int32(0), LogicalProperty=false, OnOffStringProperty="off", ColorStringProperty="red", StorageClass="CalData", MemorySection="CCM_CAL", DataType="VCCFac30", Min=0, Max=1, Unit="NoUnit")  % Preferred Defroster part at second row when manual Vent and Defroster are selected.
PartForDefrstForRowSecDurgVentDefrstForHeatUp = AUTOSAR4.Parameter([0.388 0.377 0.368 0.359 0.351 0.346 0.342 0.338 0.326 0.317], DoubleProperty=0, Int32Property=int32(0), LogicalProperty=false, OnOffStringProperty="off", ColorStringProperty="red", StorageClass="CalData", MemorySection="CCM_CAL", DataType="VCCFac30", Min=0, Max=1, Unit="NoUnit")  % Preferred Defroster part at second row during heat-up phase when manual Vent and Defroster are selected.
PartForDefrstForRowSecDurgVentFlr = AUTOSAR4.Parameter([0.101 0.097 0.094 0.09 0.083 0.025 0.025 0.025 0.024 0.023], DoubleProperty=0, Int32Property=int32(0), LogicalProperty=false, OnOffStringProperty="off", ColorStringProperty="red", StorageClass="CalData", MemorySection="CCM_CAL", DataType="VCCFac30", Min=0, Max=1, Unit="NoUnit")  % Preferred Defroster part at second row when manual Vent and Floor are selected.
PartForDefrstForRowSecDurgVentFlrDefrst = AUTOSAR4.Parameter([0.481 0.468 0.443 0.397 0.331 0.275 0.253 0.249 0.234 0.225], DoubleProperty=0, Int32Property=int32(0), LogicalProperty=false, OnOffStringProperty="off", ColorStringProperty="red", StorageClass="CalData", MemorySection="CCM_CAL", DataType="VCCFac30", Min=0, Max=1, Unit="NoUnit")  % Preferred Defroster part at second row when manual Vent, Defroster and Floor are selected.
PartForDefrstForRowSecDurgVentForHeatUp = AUTOSAR4.Parameter([0.114 0.11 0.107 0.03 0.03 0.029 0.029 0.028 0.027 0.026], DoubleProperty=0, Int32Property=int32(0), LogicalProperty=false, OnOffStringProperty="off", ColorStringProperty="red", StorageClass="CalData", MemorySection="CCM_CAL", DataType="VCCFac30", Min=0, Max=1, Unit="NoUnit")  % Preferred Defroster part at second row during heat-up phase when manual Vent is selected.
PartForVentAtLoForRowFirst = AUTOSAR4.Parameter(1, DoubleProperty=0, Int32Property=int32(0), LogicalProperty=false, OnOffStringProperty="off", ColorStringProperty="red", StorageClass="CalData", MemorySection="CCM_CAL", DataType="VCCFac30", Min=0, Max=1, Unit="NoUnit")  % Vent air distribution at Lo setting for row first
PartForVentAtLoForRowSec = AUTOSAR4.Parameter(1, DoubleProperty=0, Int32Property=int32(0), LogicalProperty=false, OnOffStringProperty="off", ColorStringProperty="red", StorageClass="CalData", MemorySection="CCM_CAL", DataType="VCCFac30", Min=0, Max=1, Unit="NoUnit")  % Vent air distribution at Lo setting for row second
PartForVentDurgDefrst = AUTOSAR4.Parameter([0.079 0.081 0.083 0.088 0.108 0.109 0.11 0.112 0.115 0.117], DoubleProperty=0, Int32Property=int32(0), LogicalProperty=false, OnOffStringProperty="off", ColorStringProperty="red", StorageClass="CalData", MemorySection="CCM_CAL", DataType="VCCFac30", Min=0, Max=1, Unit="NoUnit")  % Preferred Vent part when manual Defroster is selected.
PartForVentDurgDefrstForHeatUp = AUTOSAR4.Parameter([0.099 0.101 0.104 0.106 0.108 0.109 0.11 0.112 0.115 0.117], DoubleProperty=0, Int32Property=int32(0), LogicalProperty=false, OnOffStringProperty="off", ColorStringProperty="red", StorageClass="CalData", MemorySection="CCM_CAL", DataType="VCCFac30", Min=0, Max=1, Unit="NoUnit")  % Preferred Vent part during heat-up phase when manual Defroster is selected.
PartForVentDurgFlr = AUTOSAR4.Parameter([0.135 0.134 0.134 0.132 0.131 0.136 0.136 0.134 0.132 0.13], DoubleProperty=0, Int32Property=int32(0), LogicalProperty=false, OnOffStringProperty="off", ColorStringProperty="red", StorageClass="CalData", MemorySection="CCM_CAL", DataType="VCCFac30", Min=0, Max=1, Unit="NoUnit")  % Preferred Vent part when manual Floor is selected.
PartForVentDurgFlrDefrst = AUTOSAR4.Parameter([0.14 0.142 0.158 0.173 0.168 0.16 0.142 0.101 0.091 0.095], DoubleProperty=0, Int32Property=int32(0), LogicalProperty=false, OnOffStringProperty="off", ColorStringProperty="red", StorageClass="CalData", MemorySection="CCM_CAL", DataType="VCCFac30", Min=0, Max=1, Unit="NoUnit")  % Preferred Vent part when manual Defroster and Floor are selected.
PartForVentDurgVent = AUTOSAR4.Parameter([0.842 0.845 0.847 0.939 0.94 0.941 0.941 0.942 0.943 0.944], DoubleProperty=0, Int32Property=int32(0), LogicalProperty=false, OnOffStringProperty="off", ColorStringProperty="red", StorageClass="CalData", MemorySection="CCM_CAL", DataType="VCCFac30", Min=0, Max=1, Unit="NoUnit")  % Preferred Vent part when manual Vent is selected.
PartForVentDurgVentDefrst = AUTOSAR4.Parameter([0.597 0.608 0.617 0.621 0.63 0.635 0.638 0.643 0.654 0.664], DoubleProperty=0, Int32Property=int32(0), LogicalProperty=false, OnOffStringProperty="off", ColorStringProperty="red", StorageClass="CalData", MemorySection="CCM_CAL", DataType="VCCFac30", Min=0, Max=1, Unit="NoUnit")  % Preferred Vent part when manual Vent and Defroster are selected.
PartForVentDurgVentDefrstForHeatUp = AUTOSAR4.Parameter([0.594 0.604 0.613 0.621 0.63 0.634 0.638 0.643 0.654 0.664], DoubleProperty=0, Int32Property=int32(0), LogicalProperty=false, OnOffStringProperty="off", ColorStringProperty="red", StorageClass="CalData", MemorySection="CCM_CAL", DataType="VCCFac30", Min=0, Max=1, Unit="NoUnit")  % Preferred Vent part during heat-up phase when manual Vent and Defroster are selected.
PartForVentDurgVentFlr = AUTOSAR4.Parameter([0.591 0.586 0.581 0.577 0.601 0.676 0.69 0.705 0.726 0.725], DoubleProperty=0, Int32Property=int32(0), LogicalProperty=false, OnOffStringProperty="off", ColorStringProperty="red", StorageClass="CalData", MemorySection="CCM_CAL", DataType="VCCFac30", Min=0, Max=1, Unit="NoUnit")  % Preferred Vent part when manual Vent and Floor are selected.
PartForVentDurgVentFlrDefrst = AUTOSAR4.Parameter([0.213 0.217 0.247 0.318 0.424 0.524 0.565 0.587 0.604 0.618], DoubleProperty=0, Int32Property=int32(0), LogicalProperty=false, OnOffStringProperty="off", ColorStringProperty="red", StorageClass="CalData", MemorySection="CCM_CAL", DataType="VCCFac30", Min=0, Max=1, Unit="NoUnit")  % Preferred Vent part when manual Vent, Defroster and Floor are selected.
PartForVentDurgVentForHeatUp = AUTOSAR4.Parameter([0.859 0.862 0.866 0.939 0.94 0.941 0.941 0.942 0.943 0.944], DoubleProperty=0, Int32Property=int32(0), LogicalProperty=false, OnOffStringProperty="off", ColorStringProperty="red", StorageClass="CalData", MemorySection="CCM_CAL", DataType="VCCFac30", Min=0, Max=1, Unit="NoUnit")  % Preferred Vent part during heat-up phase when manual Vent is selected.
PartForVentForRowSecDurgDefrst = AUTOSAR4.Parameter([0.079 0.081 0.083 0.088 0.108 0.109 0.11 0.112 0.115 0.117], DoubleProperty=0, Int32Property=int32(0), LogicalProperty=false, OnOffStringProperty="off", ColorStringProperty="red", StorageClass="CalData", MemorySection="CCM_CAL", DataType="VCCFac30", Min=0, Max=1, Unit="NoUnit")  % Preferred Vent part at second row when manual Defroster is selected.
PartForVentForRowSecDurgDefrstForHeatUp = AUTOSAR4.Parameter([0.099 0.101 0.104 0.106 0.108 0.109 0.11 0.112 0.115 0.117], DoubleProperty=0, Int32Property=int32(0), LogicalProperty=false, OnOffStringProperty="off", ColorStringProperty="red", StorageClass="CalData", MemorySection="CCM_CAL", DataType="VCCFac30", Min=0, Max=1, Unit="NoUnit")  % Preferred Vent part at second row during heat-up phase when manual Defroster is selected.
PartForVentForRowSecDurgFlr = AUTOSAR4.Parameter([0.135 0.134 0.134 0.132 0.131 0.136 0.136 0.134 0.132 0.13], DoubleProperty=0, Int32Property=int32(0), LogicalProperty=false, OnOffStringProperty="off", ColorStringProperty="red", StorageClass="CalData", MemorySection="CCM_CAL", DataType="VCCFac30", Min=0, Max=1, Unit="NoUnit")  % Preferred Vent part at second row when manual Floor is selected.
PartForVentForRowSecDurgFlrDefrst = AUTOSAR4.Parameter([0.14 0.142 0.158 0.173 0.168 0.16 0.142 0.101 0.091 0.095], DoubleProperty=0, Int32Property=int32(0), LogicalProperty=false, OnOffStringProperty="off", ColorStringProperty="red", StorageClass="CalData", MemorySection="CCM_CAL", DataType="VCCFac30", Min=0, Max=1, Unit="NoUnit")  % Preferred Vent part at second row when manual Defroster and Floor are selected.
PartForVentForRowSecDurgVent = AUTOSAR4.Parameter([0.842 0.845 0.847 0.939 0.94 0.941 0.941 0.942 0.943 0.944], DoubleProperty=0, Int32Property=int32(0), LogicalProperty=false, OnOffStringProperty="off", ColorStringProperty="red", StorageClass="CalData", MemorySection="CCM_CAL", DataType="VCCFac30", Min=0, Max=1, Unit="NoUnit")  % Preferred Vent part at second row when manual Vent is selected.
PartForVentForRowSecDurgVentDefrst = AUTOSAR4.Parameter([0.597 0.608 0.617 0.621 0.63 0.635 0.638 0.643 0.654 0.664], DoubleProperty=0, Int32Property=int32(0), LogicalProperty=false, OnOffStringProperty="off", ColorStringProperty="red", StorageClass="CalData", MemorySection="CCM_CAL", DataType="VCCFac30", Min=0, Max=1, Unit="NoUnit")  % Preferred Vent part at second row when manual Vent and Defroster are selected.
PartForVentForRowSecDurgVentDefrstForHeatUp = AUTOSAR4.Parameter([0.594 0.604 0.613 0.621 0.63 0.634 0.638 0.643 0.654 0.664], DoubleProperty=0, Int32Property=int32(0), LogicalProperty=false, OnOffStringProperty="off", ColorStringProperty="red", StorageClass="CalData", MemorySection="CCM_CAL", DataType="VCCFac30", Min=0, Max=1, Unit="NoUnit")  % Preferred Vent part at second row during heat-up phase when manual Vent and Defroster are selected.
PartForVentForRowSecDurgVentFlr = AUTOSAR4.Parameter([0.591 0.586 0.581 0.577 0.601 0.676 0.69 0.705 0.726 0.725], DoubleProperty=0, Int32Property=int32(0), LogicalProperty=false, OnOffStringProperty="off", ColorStringProperty="red", StorageClass="CalData", MemorySection="CCM_CAL", DataType="VCCFac30", Min=0, Max=1, Unit="NoUnit")  % Preferred Vent part at second row when manual Vent and Floor are selected.
PartForVentForRowSecDurgVentFlrDefrst = AUTOSAR4.Parameter([0.213 0.217 0.247 0.318 0.424 0.524 0.565 0.587 0.604 0.618], DoubleProperty=0, Int32Property=int32(0), LogicalProperty=false, OnOffStringProperty="off", ColorStringProperty="red", StorageClass="CalData", MemorySection="CCM_CAL", DataType="VCCFac30", Min=0, Max=1, Unit="NoUnit")  % Preferred Vent part at second row when manual Vent, Defroster and Floor are selected.
PartForVentForRowSecDurgVentForHeatUp = AUTOSAR4.Parameter([0.859 0.862 0.866 0.939 0.94 0.941 0.941 0.942 0.943 0.944], DoubleProperty=0, Int32Property=int32(0), LogicalProperty=false, OnOffStringProperty="off", ColorStringProperty="red", StorageClass="CalData", MemorySection="CCM_CAL", DataType="VCCFac30", Min=0, Max=1, Unit="NoUnit")  % Preferred Vent part at second row during heat-up phase when manual Vent is selected.
PartMax = Simulink.Parameter(1, StorageClass="Define", DataType="Fac30")  % Maximum for use when calculating parts
PartMin = Simulink.Parameter(0, StorageClass="Define", DataType="Fac30")  % Minimum for use when calculating parts
PartOfAirFlowForRowFirstDurgPreClngForHvacLvl2 = AUTOSAR4.Parameter(0.8, DoubleProperty=0, Int32Property=int32(0), LogicalProperty=false, OnOffStringProperty="off", ColorStringProperty="red", StorageClass="CalData", MemorySection="CCM_CAL", DataType="VCCFac30", Min=0, Max=1, Unit="NoUnit")  % Part of the total precleaning airflow that shall be requested for first seat row in a car with 2 zone HVAC [-]
PartOfAirFlowForRowFirstDurgPreClngForHvacLvl4 = AUTOSAR4.Parameter(0.7, DoubleProperty=0, Int32Property=int32(0), LogicalProperty=false, OnOffStringProperty="off", ColorStringProperty="red", StorageClass="CalData", MemorySection="CCM_CAL", DataType="VCCFac30", Min=0, Max=1, Unit="NoUnit")  % Part of the total precleaning airflow that shall be directed to first seat row in a car with 4 zone HVAC [-]
PartOfAirFlowForVentDurgPreClngForRowFirst = AUTOSAR4.Parameter(0.5, DoubleProperty=0, Int32Property=int32(0), LogicalProperty=false, OnOffStringProperty="off", ColorStringProperty="red", StorageClass="CalData", MemorySection="CCM_CAL", DataType="VCCFac30", Min=0, Max=1, Unit="NoUnit")  % Part of the vent/floor airflow that shall be directed to vent on first seat row durging precleaning. [-]
PartOfAirFlowForVentDurgPreClngForRowSec = AUTOSAR4.Parameter(0.5, DoubleProperty=0, Int32Property=int32(0), LogicalProperty=false, OnOffStringProperty="off", ColorStringProperty="red", StorageClass="CalData", MemorySection="CCM_CAL", DataType="VCCFac30", Min=0, Max=1, Unit="NoUnit")  % Part of the vent/floor airflow that shall be directed to vent on second seat row durging precleaning. [-]
Perc30 = Simulink.NumericType(DataTypeMode="Fixed-point: slope and bias scaling", SignednessBool=true, WordLength=16, FixedExponent=-8, HeaderFile="Rte_Type.h")
Perc8Max = Simulink.Parameter(100, StorageClass="Define", DataType="Perc8")  % Max value for datatype Perc8
Perc8Min = Simulink.Parameter(0, StorageClass="Define", DataType="Perc8")  % Zero value for datatype Perc8
PosnReqForActrModForAutForCooltHiForClimaCtrlMan = AUTOSAR4.Parameter(repmat(70, 1, 6), DoubleProperty=0, Int32Property=int32(0), LogicalProperty=false, OnOffStringProperty="off", ColorStringProperty="red", StorageClass="CalData", MemorySection="CCM_CAL", DataType="Perc30", Min=0, Max=100, Unit="Perc")  % Mode distribution actuator position for auto during high coolant temp in manual fan off. [Perc]
PosnReqForActrModForAutForCooltLoForClimaCtrlMan = AUTOSAR4.Parameter(repmat(70, 1, 6), DoubleProperty=0, Int32Property=int32(0), LogicalProperty=false, OnOffStringProperty="off", ColorStringProperty="red", StorageClass="CalData", MemorySection="CCM_CAL", DataType="Perc30", Min=0, Max=100, Unit="Perc")  % Mode distribution actuator position for auto during low coolant temp in manual fan off. [Perc]
PosnReqForActrModForDefrstForCooltHiForClimaCtrlMan = AUTOSAR4.Parameter(repmat(0, 1, 6), DoubleProperty=0, Int32Property=int32(0), LogicalProperty=false, OnOffStringProperty="off", ColorStringProperty="red", StorageClass="CalData", MemorySection="CCM_CAL", DataType="Perc30", Min=0, Max=100, Unit="Perc")  % Mode distribution actuator position for defrost during high coolant temp in MCC. [Perc]
PosnReqForActrModForDefrstForCooltLoForClimaCtrlMan = AUTOSAR4.Parameter(repmat(0, 1, 6), DoubleProperty=0, Int32Property=int32(0), LogicalProperty=false, OnOffStringProperty="off", ColorStringProperty="red", StorageClass="CalData", MemorySection="CCM_CAL", DataType="Perc30", Min=0, Max=100, Unit="Perc")  % Mode distribution actuator position for defrost during low coolant temp in MCC. [Perc]
PosnReqForActrModForDefrstMaxForClimaCtrlMan = AUTOSAR4.Parameter(0, DoubleProperty=0, Int32Property=int32(0), LogicalProperty=false, OnOffStringProperty="off", ColorStringProperty="red", StorageClass="CalData", MemorySection="CCM_CAL", DataType="Perc30", Min=0, Max=100, Unit="Perc")  % Mode distribution actuator position for max defroster in MCC. [Perc]
PosnReqForActrModForFlrDefrstForClimaCtrlMan = AUTOSAR4.Parameter(repmat(17, 1, 6), DoubleProperty=0, Int32Property=int32(0), LogicalProperty=false, OnOffStringProperty="off", ColorStringProperty="red", StorageClass="CalData", MemorySection="CCM_CAL", DataType="Perc30", Min=0, Max=100, Unit="Perc")  % Mode distribution actuator position for floor/defroster in MCC. [Perc]
PosnReqForActrModForFlrForClimaCtrlMan = AUTOSAR4.Parameter(repmat(25, 1, 6), DoubleProperty=0, Int32Property=int32(0), LogicalProperty=false, OnOffStringProperty="off", ColorStringProperty="red", StorageClass="CalData", MemorySection="CCM_CAL", DataType="Perc30", Min=0, Max=100, Unit="Perc")  % Mode distribution actuator position for floor in MCC. [Perc]
PosnReqForActrModForFlrVentDefrstForClimaCtrlMan = AUTOSAR4.Parameter(repmat(38, 1, 6), DoubleProperty=0, Int32Property=int32(0), LogicalProperty=false, OnOffStringProperty="off", ColorStringProperty="red", StorageClass="CalData", MemorySection="CCM_CAL", DataType="Perc30", Min=0, Max=100, Unit="Perc")  % Mode distribution actuator position for floor/vent/defroster in MCC. [Perc]
PosnReqForActrModForFlrVentForClimaCtrlMan = AUTOSAR4.Parameter(repmat(50, 1, 6), DoubleProperty=0, Int32Property=int32(0), LogicalProperty=false, OnOffStringProperty="off", ColorStringProperty="red", StorageClass="CalData", MemorySection="CCM_CAL", DataType="Perc30", Min=0, Max=100, Unit="Perc")  % Mode distribution actuator position for floor/vent in MCC. [Perc]
PosnReqForActrModForPreCdngForClimaCtrlMan = AUTOSAR4.Parameter(5, DoubleProperty=0, Int32Property=int32(0), LogicalProperty=false, OnOffStringProperty="off", ColorStringProperty="red", StorageClass="CalData", MemorySection="CCM_CAL", DataType="Perc30", Min=0, Max=100, Unit="Perc")  % Initial mode distribution actuator position when preconditioning is active in MCC. [Perc]
PosnReqForActrModForPreCdngForClimaCtrlManDurgSecPha = AUTOSAR4.Parameter(25, DoubleProperty=0, Int32Property=int32(0), LogicalProperty=false, OnOffStringProperty="off", ColorStringProperty="red", StorageClass="CalData", MemorySection="CCM_CAL", DataType="Perc30", Min=0, Max=100, Unit="Perc")  % Mode distribution actuator position when preconditioning has been active for a certain time in MCC. [Perc]
PosnReqForActrModForVentDefrstForCooltHiForClimaCtrlMan = AUTOSAR4.Parameter(repmat(82, 1, 6), DoubleProperty=0, Int32Property=int32(0), LogicalProperty=false, OnOffStringProperty="off", ColorStringProperty="red", StorageClass="CalData", MemorySection="CCM_CAL", DataType="Perc30", Min=0, Max=100, Unit="Perc")  % Mode distribution actuator position for vent/defrost during high coolant temp in MCC. [Perc]
PosnReqForActrModForVentDefrstForCooltLoForClimaCtrlMan = AUTOSAR4.Parameter(repmat(82, 1, 6), DoubleProperty=0, Int32Property=int32(0), LogicalProperty=false, OnOffStringProperty="off", ColorStringProperty="red", StorageClass="CalData", MemorySection="CCM_CAL", DataType="Perc30", Min=0, Max=100, Unit="Perc")  % Mode distribution actuator position for vent/defrost during low coolant temp in MCC. [Perc]
PosnReqForActrModForVentForCooltHiForClimaCtrlMan = AUTOSAR4.Parameter(repmat(70, 1, 6), DoubleProperty=0, Int32Property=int32(0), LogicalProperty=false, OnOffStringProperty="off", ColorStringProperty="red", StorageClass="CalData", MemorySection="CCM_CAL", DataType="Perc30", Min=0, Max=100, Unit="Perc")  % Mode distribution actuator position for vent during high coolant temp in MCC. [Perc]
PosnReqForActrModForVentForCooltLoForClimaCtrlMan = AUTOSAR4.Parameter(repmat(70, 1, 6), DoubleProperty=0, Int32Property=int32(0), LogicalProperty=false, OnOffStringProperty="off", ColorStringProperty="red", StorageClass="CalData", MemorySection="CCM_CAL", DataType="Perc30", Min=0, Max=100, Unit="Perc")  % Mode distribution actuator position for vent during low coolant temp in MCC. [Perc]
PwrMin = Simulink.Parameter(0, StorageClass="Define", DataType="Pwr33")  % Minimum power, using data type Pwr33
RatForFirstRowHvacAirMFlowMaxAvl = AUTOSAR4.Parameter(0.5, DoubleProperty=0, Int32Property=int32(0), LogicalProperty=false, OnOffStringProperty="off", ColorStringProperty="red", StorageClass="CalData", MemorySection="CCM_CAL", DataType="VCCFac30", Min=0, Max=1, Unit="NoUnit")  % First row HVAC mass air flow max availabe ratio. [-]
RatForLeftRiHvacAirMFlowMaxAvl = AUTOSAR4.Parameter(0.5, DoubleProperty=0, Int32Property=int32(0), LogicalProperty=false, OnOffStringProperty="off", ColorStringProperty="red", StorageClass="CalData", MemorySection="CCM_CAL", DataType="VCCFac30", Min=0, Max=1, Unit="NoUnit")  % Left and right HVAC mass air flow max availabe ratio. [-]
ScaFacForSunLoad = Simulink.Parameter(1000, StorageClass="Define", DataType="SunLoad30")  % Used for scaling of Sun Load
SecPerHr = Simulink.Parameter(3600, StorageClass="Define", DataType="VCCTi33")  % Number of seconds in one minute
SecPerMins = Simulink.Parameter(60, StorageClass="Define", DataType="VCCTi33")  % Number of seconds in one minute
Sig = Simulink.Signal()
SwitchHvacFanLvl1orNo = AUTOSAR4.Parameter(0, DoubleProperty=0, Int32Property=int32(0), LogicalProperty=false, OnOffStringProperty="off", ColorStringProperty="red", StorageClass="CalData", MemorySection="CCM_CAL", DataType="Boolean", Min=0, Max=1, Unit="NoUnit")  % Switch Hvac fanlvl one or not
T30 = Simulink.NumericType(DataTypeMode="Fixed-point: slope and bias scaling", SignednessBool=true, WordLength=16, FixedExponent=-8, HeaderFile="Rte_Type.h")
T31 = Simulink.NumericType(DataTypeMode="Fixed-point: slope and bias scaling", SignednessBool=true, WordLength=16, FixedExponent=-6, HeaderFile="Rte_Type.h")
TLimForActvnOfAirFlowLimInCmft = AUTOSAR4.Parameter(repmat(5, 1, 5), DoubleProperty=0, Int32Property=int32(0), LogicalProperty=false, OnOffStringProperty="off", ColorStringProperty="red", StorageClass="CalData", MemorySection="CCM_CAL", DataType="VCCT30", Min=-20, Max=40, Unit="DegCgrd")  % Minimum difference between requested and estimated HEX temp for activation of HEX limit in comfort. [DegC]
TLimForAirTReqForRowFirstForActvnOfAirFlowLim = AUTOSAR4.Parameter(repmat(5, 1, 5), DoubleProperty=0, Int32Property=int32(0), LogicalProperty=false, OnOffStringProperty="off", ColorStringProperty="red", StorageClass="CalData", MemorySection="CCM_CAL", DataType="VCCT30", Min=-20, Max=40, Unit="DegCgrd")  % Minimum difference between requested air temp at first row and estimated HEX temp for activation of HEX limit in comfort. [DegC]
TLimForAirTReqForRowFirstForDeactvnOfAirFlowLim = AUTOSAR4.Parameter(repmat(-2, 1, 5), DoubleProperty=0, Int32Property=int32(0), LogicalProperty=false, OnOffStringProperty="off", ColorStringProperty="red", StorageClass="CalData", MemorySection="CCM_CAL", DataType="VCCT30", Min=-20, Max=40, Unit="DegCgrd")  % Minimum difference between requested air temp at first row and estimated HEX temp for deactivation of HEX limit in comfort. [DegC]
TLimForAirTReqForRowSecForActvnOfAirFlowLim = AUTOSAR4.Parameter(repmat(5, 1, 5), DoubleProperty=0, Int32Property=int32(0), LogicalProperty=false, OnOffStringProperty="off", ColorStringProperty="red", StorageClass="CalData", MemorySection="CCM_CAL", DataType="VCCT30", Min=-20, Max=40, Unit="DegCgrd")  % Minimum difference between requested air temp at second row and estimated HEX temp for activation of HEX limit in comfort. [DegC]
TLimForAirTReqForRowSecForDeactvnOfAirFlowLim = AUTOSAR4.Parameter(repmat(-2, 1, 5), DoubleProperty=0, Int32Property=int32(0), LogicalProperty=false, OnOffStringProperty="off", ColorStringProperty="red", StorageClass="CalData", MemorySection="CCM_CAL", DataType="VCCT30", Min=-20, Max=40, Unit="DegCgrd")  % Minimum difference between requested air temp at second row and estimated HEX temp for deactivation of HEX limit in comfort. [DegC]
TLimForDeactvnOfAirFlowLimInCmft = AUTOSAR4.Parameter(repmat(-2, 1, 5), DoubleProperty=0, Int32Property=int32(0), LogicalProperty=false, OnOffStringProperty="off", ColorStringProperty="red", StorageClass="CalData", MemorySection="CCM_CAL", DataType="VCCT30", Min=-20, Max=40, Unit="DegCgrd")  % Minimum difference between requested and estimated HEX temp for deactivation of HEX limit in comfort. [DegC]
TLimOfAirTFromHeatgEstimdForFlrDefrstManMod = AUTOSAR4.Parameter(8, DoubleProperty=0, Int32Property=int32(0), LogicalProperty=false, OnOffStringProperty="off", ColorStringProperty="red", StorageClass="CalData", MemorySection="CCM_CAL", DataType="VCCT30", Min=-40, Max=120, Unit="DegCgrd")  % Temp limit of air temperature from hex.
TLimOfAirTFromHeatgEstimdManMod = AUTOSAR4.Parameter(30, DoubleProperty=0, Int32Property=int32(0), LogicalProperty=false, OnOffStringProperty="off", ColorStringProperty="red", StorageClass="CalData", MemorySection="CCM_CAL", DataType="VCCT30", Min=-40, Max=120, Unit="DegCgrd")  % Temp limit of air temperature from hex.
TLimOfClimaManModForAmbTLow = AUTOSAR4.Parameter(20, DoubleProperty=0, Int32Property=int32(0), LogicalProperty=false, OnOffStringProperty="off", ColorStringProperty="red", StorageClass="CalData", MemorySection="CCM_CAL", DataType="VCCT30", Min=-20, Max=100, Unit="DegCgrd")  % Temp limit for ambt temp is low. [DegC]
Ti33 = Simulink.AliasType(BaseType="uint16", HeaderFile="Rte_Type.h")
TiForPosnReqForActrModForPreCdngForClimaCtrlMan = AUTOSAR4.Parameter(40, DoubleProperty=0, Int32Property=int32(0), LogicalProperty=false, OnOffStringProperty="off", ColorStringProperty="red", StorageClass="CalData", MemorySection="CCM_CAL", DataType="VCCTi39", Min=0, Max=40, Unit="Min")  % Time until second mode distribution is set when preconditioning is active in MCC. [Min]
TiForRateLimOfFanInCtrlManInRunngStb = AUTOSAR4.Parameter(2, DoubleProperty=0, Int32Property=int32(0), LogicalProperty=false, OnOffStringProperty="off", ColorStringProperty="red", StorageClass="CalData", MemorySection="CCM_CAL", DataType="VCCTi33", Min=0, Max=10, Unit="Sec")  % Time for change of requested fan speed in MCC when entering silent idle. [s]
TiLimForHexLowFlowForVedMod = AUTOSAR4.Parameter(300, DoubleProperty=0, Int32Property=int32(0), LogicalProperty=false, OnOffStringProperty="off", ColorStringProperty="red", StorageClass="CalData", MemorySection="CCM_CAL", DataType="VCCTi33", Min=0, Max=3600, Unit="Sec")  % Time limit for low hex temperature for vehmod when abandun or inactive chang  to convenience active driving.
TiLimForHexLowFlowLimAdjmtOfTotFlow = AUTOSAR4.Parameter(repmat(900, 1, 5), DoubleProperty=0, Int32Property=int32(0), LogicalProperty=false, OnOffStringProperty="off", ColorStringProperty="red", StorageClass="CalData", MemorySection="CCM_CAL", DataType="VCCTi33", Min=0, Max=3600, Unit="Sec")  % Time limit for low hex temperature for ClimaAdjmtOfTotFlowMgr
TiLimForHexLowFlowLimAdjmtOfTotFlowDefrstFlr = AUTOSAR4.Parameter(repmat(20, 1, 5), DoubleProperty=0, Int32Property=int32(0), LogicalProperty=false, OnOffStringProperty="off", ColorStringProperty="red", StorageClass="CalData", MemorySection="CCM_CAL", DataType="VCCTi33", Min=0, Max=3600, Unit="Sec")  % Time limit for low hex temperature for ClimaAdjmtOfTotFlowMgr
TotFlowLimDurgPwrAllwdLo = AUTOSAR4.Parameter(300, DoubleProperty=0, Int32Property=int32(0), LogicalProperty=false, OnOffStringProperty="off", ColorStringProperty="red", StorageClass="CalData", MemorySection="CCM_CAL", DataType="AirFlow30", Min=0, Max=750, Unit="KgPerHour")  % Max front HVAC airflow during power allowed low.
VCCActrPosnMax = Simulink.Parameter(100, StorageClass="Define", DataType="VCCPerc30")  % Max request for actuator position
VCCActrPosnMin = Simulink.Parameter(0, StorageClass="Define", DataType="VCCPerc30")  % Min request for actuator position
VCCAirFlow30 = Simulink.NumericType(DataTypeMode="Fixed-point: binary point scaling", SignednessBool=true, WordLength=16, FixedExponent=-5, DataScope="Imported", HeaderFile="Rte_Type.h")
VCCAirVol = Simulink.NumericType(DataTypeMode="Fixed-point: binary point scaling", SignednessBool=false, WordLength=16, FixedExponent=-8, DataScope="Imported", HeaderFile="Rte_Type.h")  % m^3
VCCCmptmtMdlPrm = Simulink.NumericType(DataTypeMode="Fixed-point: binary point scaling", SignednessBool=true, WordLength=32, FixedExponent=-24, DataScope="Imported", HeaderFile="Rte_Type.h")
VCCCooltFlow = Simulink.NumericType(DataTypeMode="Fixed-point: binary point scaling", SignednessBool=true, WordLength=16, FixedExponent=-9, DataScope="Imported", HeaderFile="Rte_Type.h")  % Type for coolant flow. [-64, 63] resolution 2^-9
VCCEgy30 = Simulink.NumericType(DataTypeMode="Fixed-point: binary point scaling", SignednessBool=true, WordLength=16, FixedExponent=-1, DataScope="Imported", HeaderFile="Rte_Type.h")  % Energy data type
VCCEgyMin = Simulink.Parameter(0, StorageClass="Define", DataType="VCCEgy30")  % Minimum energy, using data type VCCEgy30
VCCFac30 = Simulink.NumericType(DataTypeMode="Fixed-point: slope and bias scaling", SignednessBool=true, WordLength=16, FixedExponent=-14, HeaderFile="Rte_Type.h")
VCCFac32 = Simulink.NumericType(DataTypeMode="Fixed-point: slope and bias scaling", SignednessBool=true, WordLength=16, FixedExponent=-8, HeaderFile="Rte_Type.h")  % Dimensionless signed 16 bit datatype
VCCFanSpd1 = Simulink.AliasType(BaseType="uint16", HeaderFile="Rte_Type.h")  % Fan speed in rpd with resolution 1.
VCCFanSpd2 = Simulink.AliasType(BaseType="int16", DataScope="Imported", HeaderFile="Rte_Type.h")  % Fan speed in RPM with resolution 1 (signed).
VCCFanSpdInt = Simulink.NumericType(DataTypeMode="Fixed-point: binary point scaling", SignednessBool=true, WordLength=16, FixedExponent=-2, DataScope="Imported", HeaderFile="Rte_Type.h")
VCCHvacActrI = Simulink.NumericType(DataTypeMode="Fixed-point: binary point scaling", SignednessBool=false, WordLength=16, FixedExponent=-10, DataScope="Imported", HeaderFile="Rte_Type.h")
VCCHvacFanBattU = Simulink.NumericType(DataTypeMode="Fixed-point: binary point scaling", SignednessBool=false, WordLength=16, FixedExponent=-4, DataScope="Imported", HeaderFile="Rte_Type.h")
VCCHvacFanSpdGrdt30 = Simulink.AliasType(BaseType="int16", HeaderFile="Rte_Type.h")  % Data type for HVAC fan speed ramping
VCCHvacMdlPrm = Simulink.NumericType(DataTypeMode="Fixed-point: binary point scaling", SignednessBool=true, WordLength=32, FixedExponent=-24, DataScope="Imported", HeaderFile="Rte_Type.h")
VCCInt16 = Simulink.AliasType(BaseType="int16", HeaderFile="Rte_Type.h")  % To have our own definition of the int16 data-type
VCCInt32 = Simulink.AliasType(BaseType="int32", HeaderFile="Rte_Type.h")  % int32 is a reserved name in the Mentor BSW stack, therefore this alisas is used instead
VCCPartMax = Simulink.Parameter(1, StorageClass="Define", DataType="VCCFac30")  % Maximum for use when calculating parts
VCCPartMin = Simulink.Parameter(0, StorageClass="Define", DataType="VCCFac30")  % Minimum for use when calculating parts
VCCPerc30 = Simulink.NumericType(DataTypeMode="Fixed-point: binary point scaling", SignednessBool=true, WordLength=16, FixedExponent=-8, DataScope="Imported", HeaderFile="Rte_Type.h")
VCCPercGrdt1 = Simulink.NumericType(DataTypeMode="Fixed-point: binary point scaling", SignednessBool=true, WordLength=16, FixedExponent=-5, DataScope="Imported", HeaderFile="Rte_Type.h")
VCCPwr33 = Simulink.AliasType(BaseType="int16", HeaderFile="Rte_Type.h")  % Signed 16 bit integer datatype for power measured in Watt.
VCCSpd37 = Simulink.NumericType(DataTypeMode="Fixed-point: binary point scaling", SignednessBool=false, WordLength=16, FixedExponent=-7, DataScope="Imported", HeaderFile="Rte_Type.h")
VCCSunAzi30 = Simulink.NumericType(DataTypeMode="Fixed-point: binary point scaling", SignednessBool=true, WordLength=16, FixedExponent=-6, DataScope="Imported", HeaderFile="Rte_Type.h")  % Internal data type for sun azimuth angle
VCCT30 = Simulink.NumericType(DataTypeMode="Fixed-point: binary point scaling", SignednessBool=true, WordLength=16, FixedExponent=-8, DataScope="Imported", HeaderFile="Rte_Type.h")  % Type for temperatures in DegC. [-128, 127] resolution 2^-8
VCCTi33 = Simulink.AliasType(BaseType="uint16", HeaderFile="Rte_Type.h")  % data type for Time
VCCTi34 = Simulink.NumericType(DataTypeMode="Fixed-point: binary point scaling", SignednessBool=false, WordLength=16, FixedExponent=-5, DataScope="Imported", HeaderFile="Rte_Type.h")  % Fixed-point time data type used in timers and delays [s].
VCCTi39 = Simulink.AliasType(BaseType="uint16", HeaderFile="Rte_Type.h")  % Type for time in minutes. [0 2047]
VCCTiFilCon = Simulink.NumericType(DataTypeMode="Fixed-point: binary point scaling", SignednessBool=false, WordLength=16, FixedExponent=-8, DataScope="Imported", HeaderFile="Rte_Type.h")  % Filter time constant [0 255], resolution 0.00390625
VCCTiSamplePerd = Simulink.NumericType(DataTypeMode="Fixed-point: binary point scaling", SignednessBool=true, WordLength=16, FixedExponent=-12, DataScope="Imported", HeaderFile="Rte_Type.h")  % To be used for runnable period
VCCTiWD = Simulink.NumericType(DataTypeMode="Fixed-point: binary point scaling", SignednessBool=false, WordLength=16, FixedExponent=-10, DataScope="Imported", HeaderFile="Rte_Type.h")
VCCUInt16 = Simulink.AliasType(BaseType="uint16", HeaderFile="Rte_Type.h")  % uint16 is a reserved name in the Mentor BSW stack, therefore this alisas is used instead
VCCUInt32 = Simulink.AliasType(BaseType="uint32", HeaderFile="Rte_Type.h")  % uint32 is a reserved name in the Mentor BSW stack, therefore this alisas is used instead
VCCUInt8 = Simulink.AliasType(BaseType="uint8", HeaderFile="Rte_Type.h")  % uint8 is a reserved name in the Mentor BSW stack, therefore this alisas is used instead
Val0ForSunLoad30 = Simulink.Parameter(0, StorageClass="Define", DataType="SunLoad30")  % Minimum limit for defined data type
Val0ForT30 = Simulink.Parameter(0, StorageClass="Define", DataType="T30")  % Zero for defined data type
Val0ForTi39 = Simulink.Parameter(0, StorageClass="Define", DataType="Ti39")  % Zero for defined data type
Val1ForAirFlow30 = Simulink.Parameter(1, StorageClass="Define", DataType="AirFlow30")
Val22ForT30 = Simulink.Parameter(22, StorageClass="Define", DataType="T30")  % Zero for defined data type